# Grasshopper definition NOW_AI.gh (Grasshopper 1.0.7)
# plug-ins: Human, Pufferfish, MeshEdit Components, Aggregations, Human UI

# ---- group: MESH FACE COUNT
number_slider = Slider(100, range=0..200)

# ---- group: EXISTING / SHP_RISK_EXISTING
crv = Curve(Tree({0;0;0}: [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], {0;1;0}: [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], {0;2;0}: [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], {0;3;0}: [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], {0;4;0}: [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], {0;5;0}: [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]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))

# ---- group: EXISTING / SHP_VALS_METADATA
data = Data(Tree({0;0}: ["1", "2", "77017.59", "5102703"], {0;1}: ["1", "2", "77017.59", "5102703"], {0;2}: ["1", "2", "77017.59", "5102703"], {0;3}: ["1", "2", "77017.59", "5102703"], {0;4}: ["1", "2", "77017.59", "5102703"], {0;5}: ["1", "2", "77017.59", "5102703"]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))

# ---- group: SHP_RISK_1
crv_2 = Curve([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])

# ---- group: SHP_RISK_2
crv_3 = Curve([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])

# ---- group: SHP_RISK_3
crv_4 = Curve([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])

# ---- group: SHP_RISK_4
crv_5 = Curve([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])

# ---- group: SHP_RISK_5
crv_6 = Curve([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])

# ---- group: SHP_USME URB BDY
crv_7 = Curve(Tree({0;0;0}: [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], {1;0;0}: [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], {2;0;0}: [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], {3;0;0}: [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], {4;0;0}: [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], {5;0;0}: [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], {5;1;0}: [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], {5;2;0}: [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], {5;3;0}: [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], {6;0;0}: [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]))

# ---- group: SHP_USME BOUNDARY
crv_8 = Curve(Tree({0;0;0}: [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], {1;0;0}: [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], {2;0;0}: [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], {3;0;0}: [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], {4;0;0}: [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], {5;0;0}: [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], {5;1;0}: [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], {5;2;0}: [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], {5;3;0}: [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], {6;0;0}: [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]))

# ----
previewlw = CustomPreviewLineweights(Geometry=crv_8, Shader=ColourSwatch(SwatchColor=RGB(0, 0, 0)), Thickness=Slider(1, range=1..5), Absolute=False)

entwine = Entwine(Branch00=crv_2, Branch01=crv_3, Branch02=crv_4, Branch03=crv_5, Branch04=crv_6, Branch05=crv_7, FlattenInputs=True)
bang = ExplodeTree(Data=entwine)  # -> Branch0, Branch1, Branch2, Branch3, Branch4, Branch5

# ---- group: EXISTING / USME URB BDY
crv_9 = Curve(crv_8)

# ---- group: RISK 3
# EXISTING -RISK
swatch = ColourSwatch(SwatchColor=RGB(74, 130, 118))
previewlw_2 = CustomPreviewLineweights(Geometry=bang.Branch0, Shader=swatch, Thickness=Slider(1, range=1..5), Absolute=False)

# ---- group: RISK 4
previewlw_3 = CustomPreviewLineweights(
    Geometry=bang.Branch1,
    Shader=ColourSwatch(SwatchColor=RGB(78, 64, 118)),
    Thickness=Slider(3, range=1..5),
    Absolute=False)

# ---- group: RISK 5
previewlw_4 = CustomPreviewLineweights(
    Geometry=bang.Branch2,
    Shader=ColourSwatch(SwatchColor=RGB(187, 0, 118)),
    Thickness=Slider(3, range=1..5),
    Absolute=False)

# ----
brec = BoundingRectangle(Geometry=flatten(entwine), Plane=PlaneXY(0, 0, 0), Axis=0, Slide=0, Union=True)  # -> Bounding, DimensionX, DimensionY

# ---- group: BOUNDING_RECTANGLE
srf = Surface(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)

# ---- group: RH_IN:height
height = Slider(0, range=0..100)

# ----
srf_2 = Surface(srf)
mesh_uv = MeshSurface(Surface=srf_2, UCount=number_slider, VCount=number_slider, Overhang=True, Equalize=False)
facen = FaceNormals(Mesh=mesh_uv)  # -> Centers, Normals
explode = MeshExplode(Mesh=mesh_uv, Interpolate=False)
pt = Point(facen.Centers)

# ---- group: RH_IN:usmeBdy
toggle = BooleanToggle(True)

# ---- group: SRF
mesh = Mesh(mesh_uv)

# ---- group: LVL5
rgb = ColourRGB(
    Alpha=Slider(255, range=0..255),
    Red=Slider(0, range=0..255),
    Green=Slider(18, range=0..255),
    Blue=Slider(51, range=0..255))

# ---- group: LVL4
rgb_2 = ColourRGB(
    Alpha=Slider(255, range=0..255),
    Red=Slider(51, range=0..255),
    Green=Slider(65, range=0..255),
    Blue=Slider(92, range=0..255))

# ---- group: LVL3
rgb_3 = ColourRGB(
    Alpha=Slider(255, range=0..255),
    Red=Slider(92, range=0..255),
    Green=Slider(103, range=0..255),
    Blue=Slider(125, range=0..255))

# ---- group: LVL2
rgb_4 = ColourRGB(
    Alpha=Slider(255, range=0..255),
    Red=Slider(151, range=0..255),
    Green=Slider(157, range=0..255),
    Blue=Slider(172, range=0..255))

# ---- group: LVL1
rgb_5 = ColourRGB(
    Alpha=Slider(0, range=0..255),
    Red=Slider(202, range=0..255),
    Green=Slider(240, range=0..255),
    Blue=Slider(248, range=0..255))

# ---- group: LVL2
crv_10 = Curve(bang.Branch1)

# ---- group: LVL3
crv_11 = Curve(bang.Branch2)

# ---- group: LVL4
crv_12 = Curve(bang.Branch3)

# ---- group: LVL5
crv_13 = Curve(bang.Branch4)

# ---- group: seed
number_slider_2 = Slider(44, range=0..100)

# ----
pt_2 = Point(pt)
incurves = PointInCurves(Point=pt_2, Curves=crv_12)  # -> Relationship, Index, Point
smaller = SmallerThan(FirstNumber="0", SecondNumber=incurves.Relationship)  # -> SmallerThan, OrEqualTo
cull = CullPattern(List=explode, CullPattern=smaller.SmallerThan)
cull_2 = CullPattern(List=pt_2, CullPattern=smaller.SmallerThan)
mcol = MeshColours(Mesh=cull, Colours=rgb_2)
dots = DotDisplay(Point=cull_2, Colour=RGB(255, 0, 0), Size=Slider(15, range=0..20))

pt_3 = Point(pt)
incurves_2 = PointInCurves(Point=pt_3, Curves=crv_10)  # -> Relationship, Index, Point
smaller_2 = SmallerThan(FirstNumber="0", SecondNumber=incurves_2.Relationship)  # -> SmallerThan, OrEqualTo
cull_3 = CullPattern(List=pt_3, CullPattern=smaller_2.SmallerThan)
cull_4 = CullPattern(List=explode, CullPattern=smaller_2.SmallerThan)
dots_2 = DotDisplay(Point=cull_3, Colour=RGB(255, 0, 0), Size=Slider(15, range=0..20))

pt_4 = Point(pt)
incurves_3 = PointInCurves(Point=pt_4, Curves=crv_13)  # -> Relationship, Index, Point
smaller_3 = SmallerThan(FirstNumber="0", SecondNumber=incurves_3.Relationship)  # -> SmallerThan, OrEqualTo
cull_5 = CullPattern(List=pt_4, CullPattern=smaller_3.SmallerThan)
cull_6 = CullPattern(List=explode, CullPattern=smaller_3.SmallerThan)
dots_3 = DotDisplay(Point=cull_5, Colour=RGB(255, 0, 0), Size=Slider(15, range=0..20))

# ----
# EXSITING RISK
swatch_2 = ColourSwatch(SwatchColor=RGB(140, 116, 181))

pt_5 = Point(pt)
incurves_4 = PointInCurves(Point=pt_5, Curves=crv_11)  # -> Relationship, Index, Point
smaller_4 = SmallerThan(FirstNumber="0", SecondNumber=incurves_4.Relationship)  # -> SmallerThan, OrEqualTo
cull_7 = CullPattern(List=pt_5, CullPattern=smaller_4.SmallerThan)
cull_8 = CullPattern(List=explode, CullPattern=smaller_4.SmallerThan)
dots_4 = DotDisplay(Point=cull_7, Colour=swatch_2, Size=Slider(15, range=0..20))

mcol_2 = MeshColours(Mesh=cull_6, Colours=[rgb_2, rgb])
mcol_3 = MeshColours(Mesh=cull_4, Colours=rgb_4)
mcol_4 = MeshColours(Mesh=cull_8, Colours=[rgb_4, rgb_3])

# ---- group: RH_OUT:E_RISK2
mesh_2 = Mesh(mcol_3)

# ---- group: RH_OUT:E_RISK3
mesh_3 = Mesh(mcol_4)

# ---- group: RH_OUT:E_RISK4
mesh_4 = Mesh(mcol)

# ---- group: RH_OUT:E_RISK5
mesh_5 = Mesh(mcol_2)

# ----
swatch_3 = ColourSwatch(SwatchColor=RGBA(255, 130, 0, 252))

# ---- group: LVL5
rgb_6 = ColourRGB(
    Alpha=Slider(255, range=0..255),
    Red=Slider(0, range=0..255),
    Green=Slider(18, range=0..255),
    Blue=Slider(51, range=0..255))

# ---- group: LVL4
rgb_7 = ColourRGB(
    Alpha=Slider(255, range=0..255),
    Red=Slider(51, range=0..255),
    Green=Slider(65, range=0..255),
    Blue=Slider(92, range=0..255))

# ---- group: LVL3
rgb_8 = ColourRGB(
    Alpha=Slider(255, range=0..255),
    Red=Slider(92, range=0..255),
    Green=Slider(103, range=0..255),
    Blue=Slider(125, range=0..255))

# ---- group: LVL2
rgb_9 = ColourRGB(
    Alpha=Slider(255, range=0..255),
    Red=Slider(151, range=0..255),
    Green=Slider(157, range=0..255),
    Blue=Slider(172, range=0..255))

# ---- group: LVL1
rgb_10 = ColourRGB(
    Alpha=Slider(0, range=0..255),
    Red=Slider(202, range=0..255),
    Green=Slider(240, range=0..255),
    Blue=Slider(248, range=0..255))

# ----
area = MeshArea(Mesh=crv_13)  # -> Area, Centroid; disabled
ma = MassAddition(Input=area.Area)  # -> Result, PartialResults; disabled
number_slider_3 = Slider(10000, range=0..10000)  # disabled
ma_2 = MassAddition(Input=ma.Result)  # -> Result, PartialResults; disabled
division = Division(A=ma_2.Result, B=number_slider_3)  # disabled
round = Round(Number=division)  # -> Nearest, Floor, Ceiling; disabled
lvl5_ha = Panel(round.Nearest)  # disabled

area_2 = MeshArea(Mesh=crv_12)  # -> Area, Centroid; disabled
ma_3 = MassAddition(Input=area_2.Area)  # -> Result, PartialResults; disabled
number_slider_4 = Slider(10000, range=0..10000)  # disabled
ma_4 = MassAddition(Input=ma_3.Result)  # -> Result, PartialResults; disabled
division_2 = Division(A=ma_4.Result, B=number_slider_4)  # disabled
round_2 = Round(Number=division_2)  # -> Nearest, Floor, Ceiling; disabled
lvl4_ha = Panel(round_2.Nearest)  # disabled

area_3 = MeshArea(Mesh=crv_11)  # -> Area, Centroid; disabled
ma_5 = MassAddition(Input=area_3.Area)  # -> Result, PartialResults; disabled

# ---- group: LVL 2
area_4 = MeshArea(Mesh=cull_4)  # -> Area, Centroid; disabled
ma_6 = MassAddition(Input=area_4.Area)  # -> Result, PartialResults; disabled

# ----
number_slider_5 = Slider(10000, range=0..10000)  # disabled
ma_7 = MassAddition(Input=ma_5.Result)  # -> Result, PartialResults; disabled
division_3 = Division(A=ma_7.Result, B=number_slider_5)  # disabled
round_3 = Round(Number=division_3)  # -> Nearest, Floor, Ceiling; disabled
lvl3_ha = Panel(round_3.Nearest)  # disabled

number_slider_6 = Slider(10000, range=0..10000)  # disabled
ma_8 = MassAddition(Input=ma_6.Result)  # -> Result, PartialResults; disabled
division_4 = Division(A=ma_8.Result, B=number_slider_6)  # disabled
round_4 = Round(Number=division_4)  # -> Nearest, Floor, Ceiling; disabled
lvl2_ha = Panel(round_4.Nearest)  # disabled

legendpar = LBLegendParameters()  # -> leg_par; plug-in component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
createlegend = LBCreateLegend(title="PROPOSED RISK MAP", legend_par=legendpar)  # -> mesh, title_obj, label_objs, label_text, colors; plug-in component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
neg = Negative(Value=Slider(2300, range=0..3000))
Y = UnitY(Factor=neg)
number_slider_7 = Slider(61, range=0..100)
panel = Panel(" FUT. POP")  # disabled

average_size_of_retail_commercial_shop_s = Slider(23, range=0..100)  # "Average Size of Retail/Commercial Shop (sq.m)"; disabled
area_of_public_space_per_inhabitant_sq_m = Slider(10, range=10..15)  # disabled
no_of_empolyments_per_household_unit = Slider(2, range=0..10)  # disabled
residential_unit_size_sq_m = Slider(76, range=0..100)  # disabled

# ---- group: CHECK BOX IN CASE WE NEED IT
panel_2 = Panel("OPEN OR CLOSE?")  # disabled
checkbox = CreateCheckbox(Label=panel_2, StartingValue=False)  # disabled

# ---- group: TEXT
panel_3 = Panel("This app shows existing Risk map for Usme - Bogota and provides the opportunity to indtroduce values to mitigate risk for future development. The project develops a workflow between GIS & Grasshopper using open source data of Bogota (IDECA) and multipurpose survey done by Secretaria Distrital de Planeacion (SDP) & DANE in 2017.")  # disabled
tb = CreateTextBlock(Text=panel_3, TextSize=8, Justification=0)  # disabled

# ---- group: DISPLAY WINDOW
panel_4 = Panel("USME - Risk Mitigation Map")  # disabled
number_slider_8 = Slider(458, range=0..1000)  # disabled
number_slider_9 = Slider(748, range=0..1000)  # disabled
usme_mitigation_map = BooleanToggle(True)  # disabled
panel_5 = Panel("helvetica")  # disabled
launchwin = LaunchWindow(
    Show=usme_mitigation_map,
    Name=panel_4,
    Width=number_slider_8,
    Height=number_slider_9,
    FontFamily=panel_5,
    ChildStatus=0,
    EnableHorizScroll=False)  # disabled

# ---- group: LOGO
number_slider_10 = Slider(783, range=0..1000)  # disabled
number_slider_11 = Slider(337, range=0..1000)  # disabled
path = FilePath("D:\IAAC\04_THESIS\02_GRASHOPPER\THESIS LOGO RHI.JPG")  # disabled
image = CreateImage(ImageSource=path, ImageWidth=number_slider_10, ImageHeight=number_slider_11)  # disabled

# ---- group: SEPARATOR
number_slider_12 = Slider(20, range=0..20)  # disabled
number_slider_13 = Slider(1.5, range=0.5..3)  # disabled
col = Colour(rgb)  # disabled
separator = CreateSeparator(Thickness=number_slider_13, Horizontal=True, Color=col, Height=number_slider_12)  # disabled

number_slider_14 = Slider(20, range=0..20)  # disabled
number_slider_15 = Slider(1.5, range=0.5..3)  # disabled
col_2 = Colour(rgb)  # disabled
separator_2 = CreateSeparator(Thickness=number_slider_15, Horizontal=True, Color=col_2, Height=number_slider_14)  # disabled

number_slider_16 = Slider(14, range=0..20)  # disabled
number_slider_17 = Slider(1.5, range=0.5..3)  # disabled
col_3 = Colour(rgb)  # disabled
separator_3 = CreateSeparator(Thickness=number_slider_17, Horizontal=True, Color=col_3, Height=number_slider_16)  # disabled

# ----
panel_6 = Panel("New Risk Map")  # disabled
panel_7 = Panel(".shp| *.shp")  # disabled
filepicker = CreateFilePicker(ButtonLabelText=panel_6, DialogType=0, MustExist=True, Filter=panel_7)  # disabled

panel_8 = Panel("https://www.arcgis.com/apps/View/index.html?appid=11323e7a892a4a69b0a0368d31513c54")  # disabled
number_slider_18 = Slider(600, range=0..1000)  # disabled
number_slider_19 = Slider(600, range=0..1000)  # disabled

# ---- group: DISPLAY WINDOW
panel_9 = Panel("USME - GIS Data")  # disabled
number_slider_20 = Slider(748, range=0..1000)  # disabled
number_slider_21 = Slider(650, range=0..1000)  # disabled
usme_gis_analysis = BooleanToggle(True)  # disabled
panel_10 = Panel("helvetica")  # disabled
launchwin_2 = LaunchWindow(
    Show=usme_gis_analysis,
    Name=panel_9,
    Width=number_slider_21,
    Height=number_slider_20,
    FontFamily=panel_10,
    ChildStatus=0,
    EnableHorizScroll=False)  # disabled

# ----
browser = CreateBrowser(URL=panel_8, Width=number_slider_18, Height=expr("X-50", number_slider_20))  # disabled

# ---- group: MESH COLOURS
entwine_2 = Entwine(
    Branch00=rgb_5,
    Branch01=rgb_4,
    Branch02=rgb_3,
    Branch03=rgb_2,
    Branch04=rgb_3,
    Branch05=rgb_2,
    Branch06=rgb,
    FlattenInputs=True)  # disabled

# ----
swatch_4 = ColourSwatch(SwatchColor=RGB(0, 0, 255))  # disabled
merge = Merge(Data1=browser)  # disabled
swatch_5 = ColourSwatch(SwatchColor=RGB(253, 234, 243))  # disabled
number_slider_22 = Slider(1, range=0.1..1)  # disabled
addelems = AddElements(Window=launchwin_2, Elements=flatten(merge), DoVLChecking=True)  # -> AddedElements, ElementNames; disabled
winprops = SetWindowProperties(Window=launchwin_2, Theme=0, ShowTitleBar=True, BackgroundColor=swatch_5, ScaleFactor=number_slider_22)  # disabled

# ---- group: EXISTING
# USME-  INTERVENTION
panel_11 = Panel("1")
item = ListItem(List=data, Index=panel_11, Wrap=True)  # -> flatten(Item)
panel_12 = Panel(item)
number_slider_23 = Slider(7000, range=0..100000)
X = UnitX(Factor=number_slider_23)

# ---- group: EXISTING / CRVS HAZ 3
equals = Equality(FirstNumber=item, SecondNumber="3")  # -> Equality, Inequality
cull_9 = CullPattern(List=flatten(crv), CullPattern=equals.Equality)
join = JoinCurves(Curves=cull_9, Preserve=False)

# ---- group: EXISTING / CRVS_HAZ4
equals_2 = Equality(FirstNumber=item, SecondNumber="4")  # -> Equality, Inequality
cull_10 = CullPattern(List=flatten(crv), CullPattern=equals_2.Equality)
join_2 = JoinCurves(Curves=cull_10, Preserve=False)

# ---- group: EXISTING / CRVS_HAZ5
equals_3 = Equality(FirstNumber=item, SecondNumber="5")  # -> Equality, Inequality
cull_11 = CullPattern(List=flatten(crv), CullPattern=equals_3.Equality)
join_3 = JoinCurves(Curves=cull_11, Preserve=False)

# ---- group: EXISTING (continued)
crv_14 = Curve(join_3)
crv_15 = Curve(join)
crv_16 = Curve(join_2)
entwine_3 = Entwine(Branch00=crv_15, Branch01=crv_16, Branch02=crv_14, Branch03=crv_9, FlattenInputs=True)
move = Move(Geometry=entwine_3, Motion=X)  # -> Geometry, Transform
bang_2 = ExplodeTree(Data=move.Geometry)  # -> Branch0, Branch1, Branch2, Branch3

# ---- group: TAG
brec_2 = BoundingRectangle(Geometry=flatten(move.Geometry), Plane=PlaneXY(0, 0, 0), Axis=0, Slide=0, Union=True)  # -> Bounding, DimensionX, DimensionY
offset = OffsetCurve(Curve=brec_2.Bounding, Distance=Slider(638, range=0..10000), Corners=1)
explode_2 = Explode(Curve=offset, Recursive=True)  # -> Segments, Vertices
midpt = CurveMiddle(Curve=explode_2.Segments)
pdecon = Deconstruct(Point=midpt)  # -> XComponent, YComponent, ZComponent
sort = SortList(Keys=pdecon.YComponent, ValuesA=explode_2.Segments)  # -> Keys, ValuesA
item_2 = ListItem(List=sort.ValuesA, Index=0, Wrap=True)  # -> Item1, Item
dash = DashPattern(Curve=brec_2.Bounding, Pattern=Slider(201, range=0..500))  # -> Dashes, Gaps
curvepoint = PointOnCurve(item_2.Item1, parameter=0.591)
swatch_6 = ColourSwatch(SwatchColor=RGB(0, 0, 0))
previewlw_5 = CustomPreviewLineweights(Geometry=dash.Dashes, Shader=swatch_6, Thickness="2", Absolute=False)
tag = TextTag(Location=curvepoint, Text="INTERVENTION", Colour=swatch_6)

# ---- group: USME URBAN BOUNDARY
crv_17 = Curve(bang_2.Branch3)

# ---- group: RISK 3
# EXISTING - WEIGHTED SUM HAZARD
swatch_7 = ColourSwatch(SwatchColor=RGB(255, 179, 118))
previewlw_6 = CustomPreviewLineweights(Geometry=bang_2.Branch0, Shader=swatch_7, Thickness=Slider(1, range=1..5), Absolute=False)

# ---- group: RISK 4
previewlw_7 = CustomPreviewLineweights(
    Geometry=bang_2.Branch1,
    Shader=ColourSwatch(SwatchColor=RGB(255, 119, 118)),
    Thickness=Slider(3, range=1..5),
    Absolute=False)

# ---- group: RISK 5
previewlw_8 = CustomPreviewLineweights(
    Geometry=bang_2.Branch2,
    Shader=ColourSwatch(SwatchColor=RGB(245, 10, 118)),
    Thickness=Slider(3, range=1..5),
    Absolute=False)

# ---- group: TAG
offset_2 = OffsetCurve(Curve=srf, Distance=Slider(638, range=0..10000), Corners=1)
explode_3 = Explode(Curve=offset_2, Recursive=True)  # -> Segments, Vertices
midpt_2 = CurveMiddle(Curve=explode_3.Segments)
pdecon_2 = Deconstruct(Point=midpt_2)  # -> XComponent, YComponent, ZComponent
sort_2 = SortList(Keys=pdecon_2.YComponent, ValuesA=explode_3.Segments)  # -> Keys, ValuesA
item_3 = ListItem(List=sort_2.ValuesA, Index=0, Wrap=True)  # -> Item1, Item
dash_2 = DashPattern(Curve=srf, Pattern=Slider(201, range=0..500))  # -> Dashes, Gaps
curvepoint_2 = PointOnCurve(item_3.Item1, parameter=0.591)
tag_2 = TextTag(Location=curvepoint_2, Text="EXISTING RISK MAP", Colour=swatch_6)
previewlw_9 = CustomPreviewLineweights(Geometry=dash_2.Dashes, Shader=ColourSwatch(SwatchColor=RGB(255, 255, 255)), Thickness="2", Absolute=False)

# ---- group: CRV INSIDE URB BOUNDARY / USME URB BDY
crv_18 = Curve(bang_2.Branch3)

# ----
X_2 = UnitX(Factor=number_slider_23)

# ---- group: BOX INTERVENTION
data_2 = Data(sort.ValuesA)
item_4 = ListItem(List=data_2, Index=0, Wrap=True)  # -> Item1, Item
line = Line(item_4.Item)
curvepoint_3 = PointOnCurve(line, parameter=0.75)

# ---- group: BOX INTERVENTION / BOX EXT RISK
data_3 = Data(sort_2.ValuesA)
item_5 = ListItem(List=data_3, Index=0, Wrap=True)
line_2 = Line(item_5)
curvepoint_4 = PointOnCurve(line_2, parameter=0.75)

# ---- group: BOX INTERVENTION
line_3 = Line(item_4.Item1)
curvepoint_5 = PointOnCurve(line_3, parameter=0.181)
curvepoint_6 = PointOnCurve(line_3, parameter=0.117)
curvepoint_7 = PointOnCurve(line_3, parameter=0.049)

# ----
pt_6 = Point(curvepoint_5)
pt_7 = Point(curvepoint_7)
pt_8 = Point(curvepoint_6)

entwine_4 = Entwine(Branch00=pt_6, Branch01=pt_8, Branch02=pt_7, FlattenInputs=True)

neg_2 = Negative(Value=Slider(2000, range=0..2000))
Y_2 = UnitY(Factor=neg_2)
move_2 = Move(Geometry=entwine_4, Motion=Y_2)  # -> Geometry, Transform
bang_3 = ExplodeTree(Data=move_2.Geometry)  # -> Branch0, Branch1, Branch2

move_3 = Move(Geometry=entwine_4, Motion=Y)  # -> Geometry, Transform
bang_4 = ExplodeTree(Data=move_3.Geometry)  # -> Branch0, Branch1, Branch2
pt_9 = Point(curvepoint_3)  # disabled

X_3 = UnitX(Factor=expr("X*2", number_slider_23))
move_4 = Move(Geometry=entwine, Motion=X_3)  # -> Geometry, Transform
bang_5 = ExplodeTree(Data=move_4.Geometry)  # -> Branch0, Branch1, Branch2, Branch3, Branch4, Branch5
crv_19 = Curve(bang_5.Branch5)
swatch_8 = ColourSwatch(SwatchColor=RGB(154, 180, 236))
swatch_9 = ColourSwatch(SwatchColor=RGB(175, 191, 204))

# ---- group: TAG
brec_3 = BoundingRectangle(Geometry=flatten(move_4.Geometry), Plane=PlaneXY(0, 0, 0), Axis=0, Slide=0, Union=True)  # -> Bounding, DimensionX, DimensionY
offset_3 = OffsetCurve(Curve=brec_3.Bounding, Distance=Slider(638, range=0..10000), Corners=1)
explode_4 = Explode(Curve=offset_3, Recursive=True)  # -> Segments, Vertices
midpt_3 = CurveMiddle(Curve=explode_4.Segments)
pdecon_3 = Deconstruct(Point=midpt_3)  # -> XComponent, YComponent, ZComponent
sort_3 = SortList(Keys=pdecon_3.YComponent, ValuesA=explode_4.Segments)  # -> Keys, ValuesA
item_6 = ListItem(List=sort_3.ValuesA, Index=0, Wrap=True)  # -> Item1, Item
dash_3 = DashPattern(Curve=brec_3.Bounding, Pattern=Slider(201, range=0..500))  # -> Dashes, Gaps
curvepoint_8 = PointOnCurve(item_6.Item1, parameter=0.591)
previewlw_10 = CustomPreviewLineweights(Geometry=dash_3.Dashes, Shader=ColourSwatch(SwatchColor=RGB(255, 255, 255)), Thickness="2", Absolute=False)
tag_3 = TextTag(Location=curvepoint_8, Text="NEW RISK MAP", Colour=swatch_6)

# ----
srf_3 = Surface(brec_3.Bounding)
mesh_uv_2 = MeshSurface(Surface=srf_3, UCount=number_slider, VCount=number_slider, Overhang=True, Equalize=False)
facen_2 = FaceNormals(Mesh=mesh_uv_2)  # -> Centers, Normals
explode_5 = MeshExplode(Mesh=mesh_uv_2, Interpolate=False)
pt_10 = Point(facen_2.Centers)

# ---- group: RISK LEVEL2 / LVL2
crv_20 = Curve(bang_5.Branch1)

# ---- group: RISK LEVEL 1 / LVL1
crv_21 = Curve(bang_5.Branch0)

# ---- group: RISK LEVEL 1
incurves_5 = PointInCurves(Point=pt_10, Curves=crv_21)  # -> Relationship, Index, Point
smaller_5 = SmallerThan(FirstNumber="0", SecondNumber=incurves_5.Relationship)  # -> SmallerThan, OrEqualTo
cull_12 = CullPattern(List=pt_10, CullPattern=smaller_5.SmallerThan)
cull_13 = CullPattern(List=explode_5, CullPattern=smaller_5.SmallerThan)
previewlw_11 = CustomPreviewLineweights(Geometry=crv_21, Shader=swatch_9, Thickness=Slider(2, range=1..3), Absolute=False)
dots_5 = DotDisplay(Point=cull_12, Colour=swatch_9, Size=Slider(15, range=0..20))
preview = CustomPreview(Geometry=cull_13, Material=swatch_9)

# ---- group: RISK LEVEL2
pt_11 = Point(pt_10)
incurves_6 = PointInCurves(Point=pt_11, Curves=crv_20)  # -> Relationship, Index, Point
smaller_6 = SmallerThan(FirstNumber="0", SecondNumber=incurves_6.Relationship)  # -> SmallerThan, OrEqualTo
cull_14 = CullPattern(List=explode_5, CullPattern=smaller_6.SmallerThan)
cull_15 = CullPattern(List=pt_10, CullPattern=smaller_6.SmallerThan)
preview_2 = CustomPreview(Geometry=cull_14, Material=swatch_8)
dots_6 = DotDisplay(Point=cull_15, Colour=swatch_8, Size=Slider(15, range=0..20))
previewlw_12 = CustomPreviewLineweights(Geometry=crv_20, Shader=swatch_8, Thickness=Slider(2, range=1..3), Absolute=False)

# ----
mcol_5 = MeshColours(Mesh=cull_14, Colours=swatch_8)
mcol_6 = MeshColours(Mesh=cull_13, Colours=swatch_9)

# ---- group: RISK LEVEL 1 / SRF
mesh_6 = Mesh(mesh_uv_2)

# ---- group: RISK LEVEL 1 / USME URB BDY
crv_22 = Curve(crv_19)

# ---- group: RISK LEVEL 1
facen_3 = FaceNormals(Mesh=mesh_6)  # -> Centers, Normals
explode_6 = MeshExplode(Mesh=mesh_6, Interpolate=False)
incurves_7 = PointInCurves(Point=facen_3.Centers, Curves=crv_20)  # -> Relationship, Index, Point
panel_13 = Panel(incurves_7.Relationship)
smaller_7 = SmallerThan(FirstNumber="0", SecondNumber=incurves_7.Relationship)  # -> SmallerThan, OrEqualTo
larger = LargerThan(FirstNumber="0", SecondNumber=incurves_7.Relationship)  # -> LargerThan, OrEqualTo
cull_16 = CullPattern(List=explode_6, CullPattern=larger.OrEqualTo)
mesh_7 = Mesh(cull_16)
facen_4 = FaceNormals(Mesh=mesh_7)  # -> flatten(Centers), Normals
incurves_8 = PointInCurves(Point=facen_4.Centers, Curves=crv_22)  # -> Relationship, Index, Point
smaller_8 = SmallerThan(FirstNumber="0", SecondNumber=incurves_8.Relationship)  # -> SmallerThan, OrEqualTo
cull_17 = CullPattern(List=mesh_7, CullPattern=smaller_8.SmallerThan)

# ----
mesh_8 = Mesh(cull_17)

# ---- group: LVL2
mesh_9 = Mesh(cull_14)

# ---- group: LVL1
mesh_10 = Mesh(mesh_8)

mcol_7 = MeshColours(Mesh=mesh_10, Colours=rgb_5)
preview_3 = CustomPreview(Geometry=mesh_10, Material=rgb_5)

# ---- group: BOX INTERVENTION / BOX NEW RISK
data_4 = Data(sort_3.ValuesA)
item_7 = ListItem(List=data_4, Index=0, Wrap=True)
line_4 = Line(item_7)
curvepoint_9 = PointOnCurve(line_4, parameter=0.75)

# ----
area_5 = MeshArea(Mesh=mesh_10)  # -> Area, Centroid
ma_9 = MassAddition(Input=area_5.Area)  # -> Result, PartialResults

ma_10 = MassAddition(Input=ma_9.Result)  # -> Result, PartialResults
division_5 = Division(A=ma_10.Result, B=Slider(10000, range=0..10000))
round_5 = Round(Number=division_5)  # -> Nearest, Floor, Ceiling
lvl1_ha = Panel(round_5.Nearest)

# ---- group: USME URBAN BOUNDARY
# USME URB BOUNDARY
crv_23 = Curve(bang.Branch5)
merge_2 = Merge(Data1=crv_17, Data2=crv_23, Data3=crv_19)
Z = UnitZ(Factor=height)
move_5 = Move(Geometry=merge_2, Motion=Z)  # -> Geometry, Transform
join_4 = JoinCurves(Curves=move_5.Geometry, Preserve=False)

# ----
filter = StreamFilter(Gate=toggle, Stream0=join_4)
panel_14 = Panel(filter)

# ---- group: RH_OUT:usme
crv_24 = Curve(filter)

# ---- group: USME URBAN BOUNDARY (continued)
previewlw_13 = CustomPreviewLineweights(Geometry=crv_24, Shader=ColourSwatch(SwatchColor=RGB(20, 0, 124)), Thickness=Slider(2, range=1..5), Absolute=False)

# ---- group: USME URB BDY
crv_25 = Curve(crv_23)

# ---- group: RISK LEVEL 1
facen_5 = FaceNormals(Mesh=mesh)  # -> Centers, Normals
explode_7 = MeshExplode(Mesh=mesh, Interpolate=False)
incurves_9 = PointInCurves(Point=facen_5.Centers, Curves=crv_3)  # -> Relationship, Index, Point
smaller_9 = SmallerThan(FirstNumber="0", SecondNumber=incurves_9.Relationship)  # -> SmallerThan, OrEqualTo
larger_2 = LargerThan(FirstNumber="0", SecondNumber=incurves_9.Relationship)  # -> LargerThan, OrEqualTo
cull_18 = CullPattern(List=explode_7, CullPattern=larger_2.OrEqualTo)
mesh_11 = Mesh(cull_18)
facen_6 = FaceNormals(Mesh=mesh_11)  # -> flatten(Centers), Normals
incurves_10 = PointInCurves(Point=facen_6.Centers, Curves=crv_25)  # -> Relationship, Index, Point
smaller_10 = SmallerThan(FirstNumber="0", SecondNumber=incurves_10.Relationship)  # -> SmallerThan, OrEqualTo
cull_19 = CullPattern(List=mesh_11, CullPattern=smaller_10.SmallerThan)

# ----
mjoin = MeshJoin(Meshes=cull_19)
mesh_12 = Mesh(cull_19)
facen_7 = FaceNormals(Mesh=mesh_12)  # -> Centers, Normals
mcol_8 = MeshColours(Mesh=mjoin, Colours=rgb_5)

# ---- group: RH_OUT:E_RISK1
mesh_13 = Mesh(mcol_8)

# ---- group: AREA USME
# PROPOSED RISK MAP AREA
area_6 = Area(Geometry=crv_23)  # -> Area, Centroid; disabled

# ----
area_7 = MeshArea(Mesh=mesh_12)  # -> Area, Centroid; disabled
ma_11 = MassAddition(Input=area_7.Area)  # -> Result, PartialResults; disabled

number_slider_24 = Slider(10000, range=0..10000)  # disabled
ma_12 = MassAddition(Input=area_6.Area)  # -> Result, PartialResults; disabled
division_6 = Division(A=ma_12.Result, B=number_slider_24)  # disabled
round_6 = Round(Number=division_6)  # -> Nearest, Floor, Ceiling; disabled
usme_ha = Panel(round_6.Nearest)  # disabled

number_slider_25 = Slider(10000, range=0..10000)  # disabled
ma_13 = MassAddition(Input=ma_11.Result)  # -> Result, PartialResults; disabled
division_7 = Division(A=ma_13.Result, B=number_slider_25)  # disabled
round_7 = Round(Number=division_7)  # -> Nearest, Floor, Ceiling; disabled
lvl1_ha_2 = Panel(round_7.Nearest)  # disabled

# ---- group: AREA USME
# PROPOSED RISK MAP AREA
area_8 = Area(Geometry=crv_23)  # -> Area, Centroid

# ----
ma_14 = MassAddition(Input=area_8.Area)  # -> Result, PartialResults
division_8 = Division(A=ma_14.Result, B=Slider(10000, range=0..10000))
round_8 = Round(Number=division_8)  # -> Nearest, Floor, Ceiling
usme_ha_2 = Panel(round_8.Nearest)

division_9 = Division(A=round.Nearest, B=round_6.Nearest)  # disabled
division_10 = Division(A=round_7.Nearest, B=round_6.Nearest)  # disabled
division_11 = Division(A=round_3.Nearest, B=round_6.Nearest)  # disabled
division_12 = Division(A=round_2.Nearest, B=round_6.Nearest)  # disabled
division_13 = Division(A=round_4.Nearest, B=round_6.Nearest)  # disabled
lvl5 = Panel(division_9)  # disabled
lvl3 = Panel(division_11)  # disabled
lvl4 = Panel(division_12)  # disabled
lvl2 = Panel(division_13)  # disabled
lvl1 = Panel(division_10)  # disabled
entwine_5 = Entwine(Branch00=lvl1, Branch01=lvl2, Branch02=lvl3, Branch03=lvl4, Branch04=lvl5, FlattenInputs=True)  # -> flatten(Result); disabled

# ---- group: SPIDER DIAGRAM
# SPIDER DIAGRAM - EXISTING RISK
number_slider_26 = Slider(1000, range=0..100000)  # disabled
cir = Circle(Plane=curvepoint_4, Radius=number_slider_26)  # disabled
multiplication = Multiplication(A=entwine_5, B=100)  # disabled
lng = ListLength(List=flatten(entwine_5))  # disabled
number_slider_27 = Slider(400, range=0..500)  # disabled
round_9 = Round(Number=multiplication)  # -> Nearest, Floor, Ceiling; disabled
number_slider_28 = Slider(0.298, range=0..1)  # disabled
number_slider_29 = Slider(0, range=0..1)  # disabled
divide = DivideCurve(Curve=cir, Count=lng, Kinks=False)  # -> Points, Tangents, Parameters; disabled
bang_6 = ExplodeTree(Data=graft(round_9.Nearest))  # -> Branch0, Branch1, Branch2, Branch3, Branch4; disabled
offset_4 = OffsetCurve(Curve=cir, Distance=number_slider_27, Corners=1)  # disabled
panel_15 = Panel(" %")  # disabled
ln = Line(StartPoint=curvepoint_4, EndPoint=divide.Points)  # disabled
divide_2 = DivideCurve(Curve=ln, Count=5, Kinks=False)  # -> Points, Tangents, Parameters; disabled
vec = VectorXYZ(XComponent=number_slider_28, YComponent=number_slider_29, ZComponent=0)  # -> Vector, Length; disabled
divide_3 = DivideCurve(Curve=offset_4, Count=lng, Kinks=False)  # -> Points, Tangents, Parameters; disabled
concat = Concatenate(FragmentA=round_9.Nearest, FragmentB=panel_15)  # disabled
flip = FlipMatrix(Data=divide_2.Points)  # disabled
eval = EvaluateCurve(Curve=ln, Parameter=flatten(entwine_5))  # -> Point, Tangent, Angle; disabled
panel_16 = Panel(" % LV5")  # disabled
panel_17 = Panel(" % LV2")  # disabled
panel_18 = Panel(" % LV3")  # disabled
panel_19 = Panel(" % LV1")  # disabled
panel_20 = Panel(" % LV4")  # disabled
addition = Addition(A=eval.Point, B=vec.Vector)  # disabled
pline = PolyLine(Vertices=flip, Closed=True)  # disabled
concat_2 = Concatenate(FragmentA=bang_6.Branch4, FragmentB=panel_16)  # disabled
concat_3 = Concatenate(FragmentA=bang_6.Branch1, FragmentB=panel_17)  # disabled
concat_4 = Concatenate(FragmentA=bang_6.Branch2, FragmentB=panel_18)  # disabled
concat_5 = Concatenate(FragmentA=bang_6.Branch0, FragmentB=panel_19)  # disabled
concat_6 = Concatenate(FragmentA=bang_6.Branch3, FragmentB=panel_20)  # disabled
number_slider_30 = Slider(2, range=1..3)  # disabled
number_slider_31 = Slider(1, range=1..3)  # disabled
number_slider_32 = Slider(81, range=0..100)  # disabled
pline_2 = PolyLine(Vertices=eval.Point, Closed=True)  # disabled
number_slider_33 = Slider(3, range=1..3)  # disabled
entwine_6 = Entwine(Branch00=concat_5, Branch01=concat_3, Branch02=concat_4, Branch03=concat_6, Branch04=concat_2, FlattenInputs=True)  # -> flatten(Result); disabled
previewlw_14 = CustomPreviewLineweights(Geometry=pline, Shader=rgb_9, Thickness=number_slider_30, Absolute=False)  # disabled
previewlw_15 = CustomPreviewLineweights(Geometry=ln, Shader=rgb_9, Thickness=number_slider_31, Absolute=False)  # disabled
previewlw_16 = CustomPreviewLineweights(Geometry=pline_2, Shader=rgb_6, Thickness=number_slider_33, Absolute=False)  # disabled
dots_7 = DotDisplay(Point=eval.Point, Colour=rgb_8, Size=number_slider_32)  # disabled
number_slider_34 = Slider(0, range=0..2)  # disabled
number_slider_35 = Slider(0, range=0..3)  # disabled
number_slider_36 = Slider(150, range=0..500)  # disabled
text = Text(
    Location=divide_3.Points,
    Text=entwine_6,
    Size=number_slider_36,
    Bold=True,
    HorizontalAlignment=number_slider_34,
    VerticalAlignment=number_slider_35)  # -> flatten(Curves); disabled
number_slider_37 = Slider(1, range=1..3)  # disabled
previewlw_17 = CustomPreviewLineweights(Geometry=text, Shader=rgb_6, Thickness=number_slider_37, Absolute=False)  # disabled

# ---- group: CRV INSIDE URB BOUNDARY
merge_3 = Merge(Data1=bang_2.Branch0, Data2=bang_2.Branch1, Data3=bang_2.Branch2)

# ---- group: CRV INSIDE URB BOUNDARY / RISK LVL3 -5
crv_26 = Curve(merge_3)

# ---- group: CRV INSIDE URB BOUNDARY (continued)
area_9 = Area(Geometry=crv_26)  # -> Area, Centroid
incurves_11 = PointInCurves(Point=area_9.Centroid, Curves=crv_18)  # -> Relationship, Index, Point
larger_3 = LargerThan(FirstNumber=incurves_11.Relationship, SecondNumber="0")  # -> LargerThan, OrEqualTo
cull_20 = CullPattern(List=crv_26, CullPattern=larger_3.LargerThan)

# ---- group: LVL 3-5
crv_27 = Curve(cull_20)
srf_4 = Surface(crv_27)

# ----
brec_4 = BoundingRectangle(Geometry=crv_18, Plane=PlaneXY(0, 0, 0), Axis=0, Slide=0, Union=True)  # -> Bounding, DimensionX, DimensionY
srf_5 = Surface(brec_4.Bounding)
area_10 = Area(Geometry=crv_27)  # -> Area, Centroid
mesh_uv_3 = MeshSurface(Surface=srf_5, UCount=number_slider, VCount=number_slider, Overhang=True, Equalize=False)
facen_8 = FaceNormals(Mesh=mesh_uv_3)  # -> Centers, Normals
explode_8 = MeshExplode(Mesh=mesh_uv_3, Interpolate=False)
pt_12 = Point(facen_8.Centers)
incurves_12 = PointInCurves(Point=pt_12, Curves=crv_27)  # -> Relationship, Index, Point
smaller_11 = SmallerThan(FirstNumber="0", SecondNumber=incurves_12.Relationship)  # -> SmallerThan, OrEqualTo
cull_21 = CullPattern(List=explode_8, CullPattern=smaller_11.SmallerThan)
cull_22 = CullPattern(List=pt_12, CullPattern=smaller_11.SmallerThan)

ma_15 = MassAddition(Input=flatten(area_10.Area))  # -> Result, PartialResults
facen_9 = FaceNormals(Mesh=cull_21)  # -> flatten(Centers), Normals

# ---- group: CALCULATIONS
round_10 = Round(Number=ma_15.Result)  # -> Nearest, Floor, Ceiling
total_area = Panel(round_10.Nearest)

# ----
ma_16 = MassAddition(Input=total_area)  # -> Result, PartialResults
division_14 = Division(A=ma_16.Result, B=Slider(10000, range=0..10000))
round_11 = Round(Number=division_14)  # -> Nearest, Floor, Ceiling
intervention_area_3_5_ha = Panel(round_11.Nearest)

# ---- group: RESIDUAL
swatch_10 = ColourSwatch(SwatchColor=RGB(8, 0, 75))
number_slider_38 = Slider(10, range=0..20)

# ---- group: RESIDENTIAL
lng_2 = ListLength(List=facen_9.Centers)

# ---- group: PUBLIC SPACE
swatch_11 = ColourSwatch(SwatchColor=RGB(0, 136, 62))
number_slider_39 = Slider(20, range=0..20)

# ---- group: COMMERCIAL
swatch_12 = ColourSwatch(SwatchColor=RGB(83, 0, 91))

# ----
X_4 = UnitX(Factor=number_slider_23)

# ---- group: LVL 2
area_11 = MeshArea(Mesh=mesh_9)  # -> Area, Centroid
ma_17 = MassAddition(Input=area_11.Area)  # -> Result, PartialResults

# ----
division_15 = Division(A=round_5.Nearest, B=round_8.Nearest)
lvl1_2 = Panel(division_15)

# ---- group: SPIDER DIAGRAM
# SPIDER DIAGRAM - INTERVENTION
number_slider_40 = Slider(1000, range=0..100000)  # disabled
cir_2 = Circle(Plane=pt_9, Radius=number_slider_40)  # disabled
number_slider_41 = Slider(400, range=0..500)  # disabled
number_slider_42 = Slider(0.298, range=0..1)  # disabled
number_slider_43 = Slider(0, range=0..1)  # disabled
offset_5 = OffsetCurve(Curve=cir_2, Distance=number_slider_41, Corners=1)  # disabled
panel_21 = Panel(" %")  # disabled
vec_2 = VectorXYZ(XComponent=number_slider_42, YComponent=number_slider_43, ZComponent=0)  # -> Vector, Length; disabled
panel_22 = Panel(" % PUBLIC SPACE")  # disabled
panel_23 = Panel(" % COMMERCIAL")  # disabled
panel_24 = Panel(" % RESI")  # disabled
number_slider_44 = Slider(2, range=1..3)  # disabled
number_slider_45 = Slider(1, range=1..3)  # disabled
number_slider_46 = Slider(81, range=0..100)  # disabled
number_slider_47 = Slider(3, range=1..3)  # disabled
number_slider_48 = Slider(0, range=0..2)  # disabled
number_slider_49 = Slider(0, range=0..3)  # disabled
number_slider_50 = Slider(150, range=0..500)  # disabled
number_slider_51 = Slider(1, range=1..3)  # disabled

# ---- group: FUTURE POPULATION
number_slider_52 = Slider(6, range=0..20)  # disabled

# ---- group: SPIDER DIAGRAM
# SPIDER DIAGRAM - PROPOSED RISK
number_slider_53 = Slider(1000, range=0..100000)  # disabled
cir_3 = Circle(Plane=curvepoint_9, Radius=number_slider_53)  # disabled
number_slider_54 = Slider(400, range=0..500)  # disabled
number_slider_55 = Slider(0.298, range=0..1)  # disabled
number_slider_56 = Slider(0, range=0..1)  # disabled
offset_6 = OffsetCurve(Curve=cir_3, Distance=number_slider_54, Corners=1)  # disabled
panel_25 = Panel(" %")  # disabled
vec_3 = VectorXYZ(XComponent=number_slider_55, YComponent=number_slider_56, ZComponent=0)  # -> Vector, Length; disabled
panel_26 = Panel(" % LV5")  # disabled
panel_27 = Panel(" % LV2")  # disabled
panel_28 = Panel(" % LV3")  # disabled
panel_29 = Panel(" % LV1")  # disabled
panel_30 = Panel(" % LV4")  # disabled
number_slider_57 = Slider(2, range=1..3)  # disabled
number_slider_58 = Slider(1, range=1..3)  # disabled
number_slider_59 = Slider(81, range=0..100)  # disabled
number_slider_60 = Slider(3, range=1..3)  # disabled
number_slider_61 = Slider(0, range=0..2)  # disabled
number_slider_62 = Slider(0, range=0..3)  # disabled
number_slider_63 = Slider(150, range=0..500)  # disabled
number_slider_64 = Slider(1, range=1..3)  # disabled

# ----
panel_31 = Panel(" NEW JOBS")  # disabled
number_slider_65 = Slider(1, range=0..2)  # disabled
number_slider_66 = Slider(0, range=0..3)  # disabled
number_slider_67 = Slider(150, range=0..500)  # disabled
number_slider_68 = Slider(90, range=0..100)  # disabled
number_slider_69 = Slider(1, range=1..3)  # disabled

number_slider_70 = Slider(1, range=0..2)  # disabled
number_slider_71 = Slider(0, range=0..3)  # disabled
number_slider_72 = Slider(150, range=0..500)  # disabled
panel_32 = Panel(" APARTMENTS")  # disabled
number_slider_73 = Slider(90, range=0..100)  # disabled
number_slider_74 = Slider(1, range=1..3)  # disabled

number_slider_75 = Slider(1, range=0..2)  # disabled
number_slider_76 = Slider(0, range=0..3)  # disabled
number_slider_77 = Slider(150, range=0..500)  # disabled
number_slider_78 = Slider(90, range=0..100)  # disabled
number_slider_79 = Slider(1, range=1..3)  # disabled

# ----
# UI ELEMENTS
percentage_of_residential = Slider(0.9, range=0..1)  # disabled
number_slider_80 = Slider(1, range=0.1..1)  # disabled
swatch_13 = ColourSwatch(SwatchColor=RGB(253, 234, 243))  # disabled
winprops_2 = SetWindowProperties(Window=launchwin, Theme=0, ShowTitleBar=True, BackgroundColor=swatch_13, ScaleFactor=number_slider_80)  # disabled

# ---- group: SLIDERS VALUES
# 1 RESI PERCERTAGE
# 2// AVERAGE UNIT SIZE
# 3//No EMPLOYMENT PER HOUSEHOLD
# 4//SQM PUBLIC SPACE X PERSON
# 5// AVR SQM POF RETAIL/COMMERCIAL
slider = CreateSlider(
    Slider=[percentage_of_residential, residential_unit_size_sq_m, no_of_empolyments_per_household_unit, average_size_of_retail_commercial_shop_s, area_of_public_space_per_inhabitant_sq_m],
    ShowBounds=False,
    ShowTicks=False,
    ShowTooltip=False,
    ShowValLabel=True,
    showLabel=True)  # disabled

# ---- group: Listener
values = ValueListener(Elements=slider, SomeProperty=True)  # -> Values, Indices; disabled

# ---- group: VALUES TO SLIDERS
bang_7 = ExplodeTree(Data=graft(values.Values))  # -> Branch0, Branch1, Branch2, Branch3, Branch4; disabled

# ---- group: CALCULATIONS / RESI %
resi_percentage = Panel(bang_7.Branch0)
num = Number(resi_percentage)

# ---- group: CALCULATIONS
resi_unit_size = Panel(bang_7.Branch1)

# ---- group: CALCULATIONS / RESI UNIT SIZE
num_2 = Number(resi_unit_size)

# ---- group: CALCULATIONS
employment_x_household = Panel(bang_7.Branch2)

public_space_x_inhabitant = Panel(bang_7.Branch4)

# ---- group: CALCULATIONS / EMPLOYMENT X HOUSEHOLD
num_3 = Number(employment_x_household)

# ---- group: CALCULATIONS / PUBLIC SPACE X INHABITANT
num_4 = Number(public_space_x_inhabitant)

# ---- group: CALCULATIONS
avrg_size_retail_shops = Panel(bang_7.Branch3)

# ---- group: CALCULATIONS / SIZE RETAIL
num_5 = Number(avrg_size_retail_shops)

# ---- group: CALCULATIONS (continued)
multiplication_2 = Multiplication(A=num, B=round_10.Nearest)
round_12 = Round(Number=multiplication_2)  # -> Nearest, Floor, Ceiling
division_16 = Division(A=round_12.Nearest, B=num_2)
round_13 = Round(Number=division_16)  # -> Nearest, Floor, Ceiling
residential_units = Panel(round_13.Nearest)
multiplication_3 = Multiplication(A=round_13.Nearest, B="3")
multiplication_4 = Multiplication(A=multiplication_3, B=num_4)
multiplication_5 = Multiplication(A=residential_units, B=num_3)
multiplication_6 = Multiplication(A=round_12.Nearest, B="100")
multiplication_7 = Multiplication(A=multiplication_4, B="100")
jobs = Panel(multiplication_5)
division_17 = Division(A=multiplication_6, B=round_10.Nearest)
division_18 = Division(A=multiplication_7, B=round_10.Nearest)
round_14 = Round(Number=division_17)  # -> Nearest, Floor, Ceiling
multiplication_8 = Multiplication(A=jobs, B=num_5)
multiplication_9 = Multiplication(A=multiplication_8, B="100")
housing = Panel(round_12.Nearest)
residential_units_2 = Panel(round_13.Nearest)
future_public_space = Panel(multiplication_4)
jobs_2 = Panel(multiplication_5)
future_population = Panel(multiplication_3)
total_area_of_commercial_retail = Panel(multiplication_8)
round_15 = Round(Number=division_18)  # -> Nearest, Floor, Ceiling
division_19 = Division(A=multiplication_9, B=round_10.Nearest)
round_16 = Round(Number=division_19)  # -> Nearest, Floor, Ceiling
division_20 = Division(A=round_10.Nearest, B=multiplication_8)
division_21 = Division(A=round_10.Nearest, B=multiplication_7)
division_22 = Division(A=round_10.Nearest, B=multiplication_6)
panel_33 = Panel(division_20)
panel_34 = Panel(division_21)
panel_35 = Panel(division_22)

# ---- group: PUBLIC SPACE / PUBLIC SPACE %
commercial = Number(round_15.Nearest)

# ---- group: RESIDENTIAL / RESIDENTIAL %
num_6 = Number(round_14.Nearest)

# ---- group: CALCULATIONS
percentage_of_residential_2 = Panel(round_14.Nearest)
of_commercial_uses = Panel(round_16.Nearest)
of_public_space = Panel(round_15.Nearest)

# ----
panel_36 = Panel(num_6)

# ---- group: RESIDENTIAL (continued)
division_23 = Division(A=num_6, B="100")
multiplication_10 = Multiplication(A=lng_2, B=division_23)
reduce = RandomReduce(List=facen_9.Centers, Reduction=multiplication_10, Seed=number_slider_2)
difference = SetDifference(SetA=facen_9.Centers, SetB=reduce)
cir_4 = Circle(Plane=difference, Radius="20")
incurves_13 = PointInCurves(Point=facen_9.Centers, Curves=cir_4)  # -> Relationship, Index, Point
smaller_12 = SmallerThan(FirstNumber="0", SecondNumber=incurves_13.Relationship)  # -> SmallerThan, OrEqualTo
cull_23 = CullPattern(List=cull_21, CullPattern=smaller_12.SmallerThan)
mesh_14 = Mesh(cull_23)
mcol_9 = MeshColours(Mesh=mesh_14, Colours=swatch_3)

# ---- group: COMMERCIAL (continued)
commercial_2 = Number(round_16.Nearest)
lng_3 = ListLength(List=reduce)
division_24 = Division(A=commercial_2, B="100")
multiplication_11 = Multiplication(A=lng_3, B=division_24)
reduce_2 = RandomReduce(List=reduce, Reduction=multiplication_11, Seed=number_slider_2)
difference_2 = SetDifference(SetA=reduce, SetB=reduce_2)
cir_5 = Circle(Plane=difference_2, Radius="20")
incurves_14 = PointInCurves(Point=facen_9.Centers, Curves=cir_5)  # -> Relationship, Index, Point
smaller_13 = SmallerThan(FirstNumber="0", SecondNumber=incurves_14.Relationship)  # -> SmallerThan, OrEqualTo
cull_24 = CullPattern(List=cull_21, CullPattern=smaller_13.SmallerThan)
mesh_15 = Mesh(cull_24)

bang_8 = ExplodeTree(Data=mesh_15)  # -> _0300, _0301, _0302

# ---- group: RESIDENTIAL
bang_9 = ExplodeTree(Data=mesh_14)  # -> _0300, _0301, _0302

# ---- group: COMMERCIAL / LVL3
mesh_16 = Mesh(bang_8._0300)

# ---- group: COMMERCIAL / LVL5
mesh_17 = Mesh(bang_8._0302)

# ---- group: COMMERCIAL / LVL4
mesh_18 = Mesh(bang_8._0301)

# ---- group: RESIDENTIAL / LEVEL3
mesh_19 = Mesh(bang_9._0300)

# ---- group: RESIDENTIAL / LEVEL4
mesh_20 = Mesh(bang_9._0301)

# ---- group: RESIDENTIAL / LEVEL 5
mesh_21 = Mesh(bang_9._0302)

# ---- group: COMMERCIAL/HA
ma_18 = MassAddition(Input=total_area_of_commercial_retail)  # -> Result, PartialResults
division_25 = Division(A=ma_18.Result, B=Slider(10000, range=0..10000))
round_17 = Round(Number=division_25)  # -> Nearest, Floor, Ceiling
commecial_ha = Panel(round_17.Nearest)

# ----
ma_19 = MassAddition(Input=future_public_space)  # -> Result, PartialResults
division_26 = Division(A=ma_19.Result, B=Slider(10000, range=0..10000))
round_18 = Round(Number=division_26)  # -> Nearest, Floor, Ceiling
public_space_ha = Panel(round_18.Nearest)

ma_20 = MassAddition(Input=housing)  # -> Result, PartialResults
division_27 = Division(A=ma_20.Result, B=Slider(10000, range=0..10000))
round_19 = Round(Number=division_27)  # -> Nearest, Floor, Ceiling
residential_ha = Panel(round_19.Nearest)

jobs_3 = Panel(jobs_2)
residential_units_3 = Panel(residential_units_2)
future_population_2 = Panel(future_population)
division_28 = Division(A=public_space_ha, B=round_11.Nearest)
division_29 = Division(A=commecial_ha, B=round_11.Nearest)
division_30 = Division(A=residential_ha, B=round_11.Nearest)
public_space = Panel(division_28)
commercial_3 = Panel(division_29)
residential = Panel(division_30)
entwine_7 = Entwine(Branch00=residential, Branch01=public_space, Branch02=commercial_3, FlattenInputs=True)  # -> flatten(Result)
division_31 = Division(A=future_population_2, B=number_slider_7)
division_32 = Division(A=residential_units_3, B=number_slider_7)
division_33 = Division(A=jobs_3, B=number_slider_7)

# ---- group: FUTURE POPULATION (continued)
neg_3 = Negative(Value=division_31)
Y_3 = UnitY(Factor=neg_3)
move_6 = Move(Geometry=bang_4.Branch0, Motion=Y_3)  # -> Geometry, Transform; disabled
ln_2 = Line(StartPoint=bang_4.Branch0, EndPoint=move_6.Geometry)  # disabled
previewlw_18 = CustomPreviewLineweights(Geometry=ln_2, Shader=rgb_6, Thickness=number_slider_52, Absolute=False)  # disabled

# ---- group: #JOBS
neg_4 = Negative(Value=division_33)
Y_4 = UnitY(Factor=neg_4)  # disabled
move_7 = Move(Geometry=bang_4.Branch2, Motion=Y_4)  # -> Geometry, Transform; disabled
ln_3 = Line(StartPoint=bang_4.Branch2, EndPoint=move_7.Geometry)  # disabled
previewlw_19 = CustomPreviewLineweights(Geometry=ln_3, Shader=swatch_12, Thickness=number_slider_52, Absolute=False)  # disabled

# ---- group: RESI UNITS
neg_5 = Negative(Value=division_32)
Y_5 = UnitY(Factor=neg_5)  # disabled
move_8 = Move(Geometry=bang_4.Branch1, Motion=Y_5)  # -> Geometry, Transform; disabled
ln_4 = Line(StartPoint=bang_4.Branch1, EndPoint=move_8.Geometry)  # disabled
previewlw_20 = CustomPreviewLineweights(Geometry=ln_4, Shader=swatch_3, Thickness=number_slider_52, Absolute=False)  # disabled

# ---- group: SPIDER DIAGRAM (continued)
multiplication_12 = Multiplication(A=entwine_7, B=100)  # disabled
lng_4 = ListLength(List=flatten(entwine_7))  # disabled
round_20 = Round(Number=multiplication_12)  # -> Nearest, Floor, Ceiling; disabled
divide_4 = DivideCurve(Curve=cir_2, Count=lng_4, Kinks=False)  # -> Points, Tangents, Parameters; disabled
bang_10 = ExplodeTree(Data=graft(round_20.Nearest))  # -> Branch0, Branch1, Branch2; disabled
ln_5 = Line(StartPoint=pt_9, EndPoint=divide_4.Points)  # disabled
divide_5 = DivideCurve(Curve=ln_5, Count=5, Kinks=False)  # -> Points, Tangents, Parameters; disabled
divide_6 = DivideCurve(Curve=offset_5, Count=lng_4, Kinks=False)  # -> Points, Tangents, Parameters; disabled
concat_7 = Concatenate(FragmentA=round_20.Nearest, FragmentB=panel_21)  # disabled
flip_2 = FlipMatrix(Data=divide_5.Points)  # disabled
eval_2 = EvaluateCurve(Curve=ln_5, Parameter=flatten(entwine_7))  # -> Point, Tangent, Angle; disabled
addition_2 = Addition(A=eval_2.Point, B=vec_2.Vector)  # disabled
pline_3 = PolyLine(Vertices=flip_2, Closed=True)  # disabled
concat_8 = Concatenate(FragmentA=bang_10.Branch1, FragmentB=panel_22)  # disabled
concat_9 = Concatenate(FragmentA=bang_10.Branch2, FragmentB=panel_23)  # disabled
concat_10 = Concatenate(FragmentA=bang_10.Branch0, FragmentB=panel_24)  # disabled
pline_4 = PolyLine(Vertices=eval_2.Point, Closed=True)  # disabled
entwine_8 = Entwine(Branch00=concat_10, Branch01=concat_8, Branch02=concat_9, FlattenInputs=True)  # -> flatten(Result); disabled
previewlw_21 = CustomPreviewLineweights(Geometry=pline_3, Shader=rgb_9, Thickness=number_slider_44, Absolute=False)  # disabled
previewlw_22 = CustomPreviewLineweights(Geometry=ln_5, Shader=rgb_9, Thickness=number_slider_45, Absolute=False)  # disabled
previewlw_23 = CustomPreviewLineweights(Geometry=pline_4, Shader=rgb_6, Thickness=number_slider_47, Absolute=False)  # disabled
dots_8 = DotDisplay(Point=eval_2.Point, Colour=rgb_8, Size=number_slider_46)  # disabled
text_2 = Text(
    Location=divide_6.Points,
    Text=entwine_8,
    Size=number_slider_50,
    Bold=True,
    HorizontalAlignment=number_slider_48,
    VerticalAlignment=number_slider_49)  # -> flatten(Curves); disabled
previewlw_24 = CustomPreviewLineweights(Geometry=text_2, Shader=rgb_6, Thickness=number_slider_51, Absolute=False)  # disabled

# ----
concat_11 = Concatenate(FragmentA=residential_units_3, FragmentB=panel_32)  # disabled
concat_12 = Concatenate(FragmentA=jobs_3, FragmentB=panel_31)  # disabled

concat_13 = Concatenate(FragmentA=future_population_2, FragmentB=panel)  # disabled
text_3 = Text(
    Location=bang_3.Branch0,
    Text=concat_13,
    Size=number_slider_77,
    Bold=True,
    HorizontalAlignment=number_slider_75,
    VerticalAlignment=number_slider_76)  # -> flatten(Curves); disabled
rotate = Rotate(Geometry=text_3, Angle=degrees(number_slider_78), Plane=bang_3.Branch0)  # -> Geometry, Transform; disabled
previewlw_25 = CustomPreviewLineweights(Geometry=rotate.Geometry, Shader=rgb_6, Thickness=number_slider_79, Absolute=False)  # disabled

text_4 = Text(
    Location=bang_3.Branch1,
    Text=concat_11,
    Size=number_slider_72,
    Bold=True,
    HorizontalAlignment=number_slider_70,
    VerticalAlignment=number_slider_71)  # -> flatten(Curves); disabled
rotate_2 = Rotate(Geometry=text_4, Angle=degrees(number_slider_73), Plane=bang_3.Branch1)  # -> Geometry, Transform; disabled
previewlw_26 = CustomPreviewLineweights(Geometry=rotate_2.Geometry, Shader=rgb_6, Thickness=number_slider_74, Absolute=False)  # disabled

text_5 = Text(
    Location=bang_3.Branch2,
    Text=concat_12,
    Size=number_slider_67,
    Bold=True,
    HorizontalAlignment=number_slider_65,
    VerticalAlignment=number_slider_66)  # -> flatten(Curves); disabled
rotate_3 = Rotate(Geometry=text_5, Angle=degrees(number_slider_68), Plane=bang_3.Branch2)  # -> Geometry, Transform; disabled
previewlw_27 = CustomPreviewLineweights(Geometry=rotate_3.Geometry, Shader=rgb_6, Thickness=number_slider_69, Absolute=False)  # disabled

# ---- group: PUBLIC SPACE
panel_37 = Panel("% PUBLIC SPACE")  # disabled
panel_38 = Panel("% PUBLIC SPACE")  # disabled
concat_14 = Concatenate(FragmentA=of_public_space, FragmentB=panel_37)  # disabled
label = CreateLabel(LabelText=panel_38, LabelSize=18, Justification=0)  # disabled
setlabel = SetLabelContents(LabelToModify=label, NewLabelContents=concat_14)  # disabled

# ---- group: RESIDENTIAL
panel_39 = Panel("% RESIDENTIAL")  # disabled
panel_40 = Panel("% RESIDENTIAL")  # disabled
concat_15 = Concatenate(FragmentA=percentage_of_residential_2, FragmentB=panel_39)  # disabled
label_2 = CreateLabel(LabelText=panel_40, LabelSize=18, Justification=0)  # disabled
setlabel_2 = SetLabelContents(LabelToModify=label_2, NewLabelContents=concat_15)  # disabled

# ---- group: COMMERCIAL
panel_41 = Panel("% COMMERCIAL")  # disabled
panel_42 = Panel("% COMMERCIAL")  # disabled
concat_16 = Concatenate(FragmentA=of_commercial_uses, FragmentB=panel_41)  # disabled
label_3 = CreateLabel(LabelText=panel_42, LabelSize=18, Justification=0)  # disabled
setlabel_3 = SetLabelContents(LabelToModify=label_3, NewLabelContents=concat_16)  # disabled

# ----
merge_4 = Merge(
    Data1=image,
    Data2=tb,
    Data3=separator,
    Data4=slider,
    Data5=separator_3,
    Data6=label_2,
    Data7=label_3,
    Data8=label,
    Data9=separator_2,
    Data10=filepicker)  # disabled

# ---- group: ELEMENTS TO WINDOW
addelems_2 = AddElements(Window=launchwin, Elements=flatten(merge_4), DoVLChecking=True)  # -> AddedElements, ElementNames; disabled

# ---- group: PUBLIC SPACE (continued)
division_34 = Division(A=commercial, B="100")
lng_5 = ListLength(List=reduce_2)
multiplication_13 = Multiplication(A=lng_5, B=division_34)
reduce_3 = RandomReduce(List=reduce_2, Reduction=multiplication_13, Seed=number_slider_2)

# ---- group: RESIDUAL (continued)
cir_6 = Circle(Plane=reduce_3, Radius="20")
incurves_15 = PointInCurves(Point=facen_9.Centers, Curves=cir_6)  # -> Relationship, Index, Point
smaller_14 = SmallerThan(FirstNumber="0", SecondNumber=incurves_15.Relationship)  # -> SmallerThan, OrEqualTo
cull_25 = CullPattern(List=cull_21, CullPattern=smaller_14.SmallerThan)
mesh_22 = Mesh(cull_25)

# ----
difference_3 = SetDifference(SetA=reduce_2, SetB=reduce_3)

# ---- group: PUBLIC SPACE (continued)
cir_7 = Circle(Plane=difference_3, Radius="20")
incurves_16 = PointInCurves(Point=facen_9.Centers, Curves=cir_7)  # -> Relationship, Index, Point
smaller_15 = SmallerThan(FirstNumber="0", SecondNumber=incurves_16.Relationship)  # -> SmallerThan, OrEqualTo
cull_26 = CullPattern(List=cull_21, CullPattern=smaller_15.SmallerThan)
mesh_23 = Mesh(cull_26)

# ----
dots_9 = DotDisplay(Point=reduce_3, Colour=swatch_10, Size=number_slider_38)
dots_10 = DotDisplay(Point=difference_3, Colour=swatch_11, Size=number_slider_39)
dots_11 = DotDisplay(Point=difference, Colour=swatch_3, Size=Slider(25, range=0..100))
dots_12 = DotDisplay(Point=difference_2, Colour=swatch_12, Size=Slider(25, range=0..100))

preview_4 = CustomPreview(Geometry=mesh_23, Material=swatch_11)
preview_5 = CustomPreview(Geometry=mesh_22, Material=swatch_10)
preview_6 = CustomPreview(Geometry=mesh_15, Material=swatch_12)
preview_7 = CustomPreview(Geometry=mesh_14, Material=swatch_3)

mesh_24 = Mesh(mesh_22)
move_9 = Move(Geometry=mesh_24, Motion=X_4)  # -> Geometry, Transform

# ---- group: LANDSCAPE MITIGATION
bang_11 = ExplodeTree(Data=mesh_22)  # -> _0300, _0301, _0302

# ---- group: P.SPACE
bang_12 = ExplodeTree(Data=mesh_23)  # -> _0300, _0301, _0302

# ---- group: P.SPACE / LVL3
mesh_25 = Mesh(bang_12._0300)

# ---- group: P.SPACE / LVL5
mesh_26 = Mesh(bang_12._0302)

# ---- group: P.SPACE / LVL4
mesh_27 = Mesh(bang_12._0301)

# ---- group: LANDSCAPE MITIGATION / LVL3
mesh_28 = Mesh(bang_11._0300)

# ---- group: LANDSCAPE MITIGATION / LVL5
mesh_29 = Mesh(bang_11._0302)

# ---- group: LANDSCAPE MITIGATION / LVL4
mesh_30 = Mesh(bang_11._0301)

# ---- group: LANDSCAPE MITIGATION
bang_13 = ExplodeTree(Data=move_9.Geometry)  # -> _0300, _0301, _0302

# ---- group: LANDSCAPE MITIGATION / LVL3
mesh_31 = Mesh(bang_13._0300)

# ---- group: LANDSCAPE MITIGATION / LVL5
mesh_32 = Mesh(bang_13._0302)

# ---- group: LANDSCAPE MITIGATION / LVL4
mesh_33 = Mesh(bang_13._0301)

# ----
mcol_10 = MeshColours(Mesh=mesh_32, Colours=rgb)
preview_8 = CustomPreview(Geometry=mesh_32, Material=rgb)

# ---- group: LVL4
mcol_11 = MeshColours(Mesh=mesh_33, Colours=rgb_2)
preview_9 = CustomPreview(Geometry=mesh_33, Material=rgb_2)

# ---- group: LVL 3
preview_10 = CustomPreview(Geometry=mesh_31, Material=rgb_3)
mcol_12 = MeshColours(Mesh=mesh_31, Colours=rgb_3)

# ---- group: LVL4
merge_5 = Merge(Data1=mesh_20, Data2=mesh_18, Data3=mesh_27, Data4=mesh_30)

# ---- group: LVL 5
merge_6 = Merge(Data1=mesh_21, Data2=mesh_17, Data3=mesh_26, Data4=mesh_29)

# ---- group: LVL 3
merge_7 = Merge(Data1=mesh_19, Data2=mesh_16, Data3=mesh_25, Data4=mesh_28)

# ----
entwine_9 = Entwine(Branch00=merge_7, Branch01=merge_5, Branch02=merge_6, FlattenInputs=True)
move_10 = Move(Geometry=entwine_9, Motion=X_2)  # -> Geometry, Transform

bang_14 = ExplodeTree(Data=move_10.Geometry)  # -> Branch0, Branch1, Branch2

# ---- group: LVL4
mcol_13 = MeshColours(Mesh=bang_14.Branch2, Colours=rgb_2)
preview_11 = CustomPreview(Geometry=bang_14.Branch2, Material=rgb_2)

# ---- group: LVL2
mcol_14 = MeshColours(Mesh=[mesh_9, bang_14.Branch0], Colours=rgb_4)
preview_12 = CustomPreview(Geometry=[mesh_9, bang_14.Branch0], Material=rgb_4)

# ---- group: LVL3
preview_13 = CustomPreview(Geometry=bang_14.Branch1, Material=rgb_3)
mcol_15 = MeshColours(Mesh=bang_14.Branch1, Colours=rgb_3)

# ----
area_12 = MeshArea(Mesh=mesh_32)  # -> Area, Centroid
ma_21 = MassAddition(Input=area_12.Area)  # -> Result, PartialResults
ma_22 = MassAddition(Input=ma_21.Result)  # -> Result, PartialResults
division_35 = Division(A=ma_22.Result, B=Slider(10000, range=0..10000))
round_21 = Round(Number=division_35)  # -> Nearest, Floor, Ceiling
lvl5_ha_2 = Panel(round_21.Nearest)

area_13 = MeshArea(Mesh=bang_14.Branch1)  # -> Area, Centroid
ma_23 = MassAddition(Input=area_13.Area)  # -> Result, PartialResults

# ---- group: 3
area_14 = MeshArea(Mesh=mesh_31)  # -> Area, Centroid
ma_24 = MassAddition(Input=area_14.Area)  # -> Result, PartialResults
addition_3 = Addition(A=ma_23.Result, B=ma_24.Result)

# ---- group: LVL 2 (continued)
area_15 = MeshArea(Mesh=bang_14.Branch0)  # -> Area, Centroid
ma_25 = MassAddition(Input=area_15.Area)  # -> Result, PartialResults
addition_4 = Addition(A=ma_17.Result, B=ma_25.Result)

# ----
ma_26 = MassAddition(Input=addition_3)  # -> Result, PartialResults
division_36 = Division(A=ma_26.Result, B=Slider(10000, range=0..10000))
round_22 = Round(Number=division_36)  # -> Nearest, Floor, Ceiling
lvl3_ha_2 = Panel(round_22.Nearest)

ma_27 = MassAddition(Input=addition_4)  # -> Result, PartialResults
division_37 = Division(A=ma_27.Result, B=Slider(10000, range=0..10000))
round_23 = Round(Number=division_37)  # -> Nearest, Floor, Ceiling
lvl2_ha_2 = Panel(round_23.Nearest)

# ---- group: 4
area_16 = MeshArea(Mesh=mesh_33)  # -> Area, Centroid
ma_28 = MassAddition(Input=area_16.Area)  # -> Result, PartialResults

# ----
area_17 = MeshArea(Mesh=bang_14.Branch2)  # -> Area, Centroid
ma_29 = MassAddition(Input=area_17.Area)  # -> Result, PartialResults

# ---- group: 4 (continued)
addition_5 = Addition(A=ma_29.Result, B=ma_28.Result)

# ----
ma_30 = MassAddition(Input=addition_5)  # -> Result, PartialResults
division_38 = Division(A=ma_30.Result, B=Slider(10000, range=0..10000))
round_24 = Round(Number=division_38)  # -> Nearest, Floor, Ceiling
lvl4_ha_2 = Panel(round_24.Nearest)

division_39 = Division(A=round_21.Nearest, B=round_8.Nearest)
division_40 = Division(A=round_22.Nearest, B=round_8.Nearest)
division_41 = Division(A=round_24.Nearest, B=round_8.Nearest)
division_42 = Division(A=round_23.Nearest, B=round_8.Nearest)
lvl5_2 = Panel(division_39)
lvl3_2 = Panel(division_40)
lvl4_2 = Panel(division_41)
lvl2_2 = Panel(division_42)
entwine_10 = Entwine(Branch00=lvl1_2, Branch01=lvl2_2, Branch02=lvl3_2, Branch03=lvl4_2, Branch04=lvl5_2, FlattenInputs=True)  # -> flatten(Result)

# ---- group: SPIDER DIAGRAM (continued)
multiplication_14 = Multiplication(A=entwine_10, B=100)  # disabled
lng_6 = ListLength(List=flatten(entwine_10))  # disabled
round_25 = Round(Number=multiplication_14)  # -> Nearest, Floor, Ceiling; disabled
divide_7 = DivideCurve(Curve=cir_3, Count=lng_6, Kinks=False)  # -> Points, Tangents, Parameters; disabled
bang_15 = ExplodeTree(Data=graft(round_25.Nearest))  # -> Branch0, Branch1, Branch2, Branch3, Branch4; disabled
ln_6 = Line(StartPoint=curvepoint_9, EndPoint=divide_7.Points)  # disabled
divide_8 = DivideCurve(Curve=ln_6, Count=5, Kinks=False)  # -> Points, Tangents, Parameters; disabled
divide_9 = DivideCurve(Curve=offset_6, Count=lng_6, Kinks=False)  # -> Points, Tangents, Parameters; disabled
concat_17 = Concatenate(FragmentA=round_25.Nearest, FragmentB=panel_25)  # disabled
flip_3 = FlipMatrix(Data=divide_8.Points)  # disabled
eval_3 = EvaluateCurve(Curve=ln_6, Parameter=flatten(entwine_10))  # -> Point, Tangent, Angle; disabled
addition_6 = Addition(A=eval_3.Point, B=vec_3.Vector)  # disabled
pline_5 = PolyLine(Vertices=flip_3, Closed=True)  # disabled
concat_18 = Concatenate(FragmentA=bang_15.Branch4, FragmentB=panel_26)  # disabled
concat_19 = Concatenate(FragmentA=bang_15.Branch1, FragmentB=panel_27)  # disabled
concat_20 = Concatenate(FragmentA=bang_15.Branch2, FragmentB=panel_28)  # disabled
concat_21 = Concatenate(FragmentA=bang_15.Branch0, FragmentB=panel_29)  # disabled
concat_22 = Concatenate(FragmentA=bang_15.Branch3, FragmentB=panel_30)  # disabled
pline_6 = PolyLine(Vertices=eval_3.Point, Closed=True)  # disabled
entwine_11 = Entwine(Branch00=concat_21, Branch01=concat_19, Branch02=concat_20, Branch03=concat_22, Branch04=concat_18, FlattenInputs=True)  # -> flatten(Result); disabled
previewlw_28 = CustomPreviewLineweights(Geometry=pline_5, Shader=rgb_9, Thickness=number_slider_57, Absolute=False)  # disabled
previewlw_29 = CustomPreviewLineweights(Geometry=ln_6, Shader=rgb_9, Thickness=number_slider_58, Absolute=False)  # disabled
previewlw_30 = CustomPreviewLineweights(Geometry=pline_6, Shader=rgb_6, Thickness=number_slider_60, Absolute=False)  # disabled
dots_13 = DotDisplay(Point=eval_3.Point, Colour=rgb_8, Size=number_slider_59)  # disabled
text_6 = Text(
    Location=divide_9.Points,
    Text=entwine_11,
    Size=number_slider_63,
    Bold=True,
    HorizontalAlignment=number_slider_61,
    VerticalAlignment=number_slider_62)  # -> flatten(Curves); disabled
previewlw_31 = CustomPreviewLineweights(Geometry=text_6, Shader=rgb_6, Thickness=number_slider_64, Absolute=False)  # disabled

# ---- group: MESH
entwine_12 = Entwine(
    Branch00=mesh_10,
    Branch01=mesh_9,
    Branch02=bang_14.Branch0,
    Branch03=bang_14.Branch1,
    Branch04=bang_14.Branch2,
    Branch05=mesh_31,
    Branch06=mesh_33,
    Branch07=mesh_32,
    FlattenInputs=True)  # disabled
number_slider_81 = Slider(550, range=0..1000)  # disabled
number_slider_82 = Slider(300, range=0..1000)  # disabled

# ----
mjoin_2 = MeshJoin(Meshes=flatten(entwine_12))  # disabled

# ---- group: MESH (continued)
_3dview = Create3DView(MeshToDisplay=mjoin_2, MeshColors=RGB(255, 0, 0), ViewWidth=number_slider_81, ViewHeight=number_slider_82)  # -> flatten(_3DView); disabled

# ---- group: UPDATE 3D VIEW
set3dview = Set3DView(_3DView=_3dview, MeshToDisplay=mjoin_2, MeshColors=flatten(entwine_2))  # disabled
