# Grasshopper definition NOW_AI_test1 [Nov-09 '21, 2209].gh (Grasshopper 1.0.7)
# plug-ins: Human, Pufferfish, MeshEdit Components

# ---- group: SHP_USME BOUNDARY
crv = Curve(Tree({0;0;0}: [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], {1;0;0}: [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], {2;0;0}: [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], {3;0;0}: [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], {4;0;0}: [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], {5;0;0}: [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], {5;1;0}: [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], {5;2;0}: [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], {5;3;0}: [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], {6;0;0}: [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]))

# ----
previewlw = CustomPreviewLineweights(Geometry=crv, Shader=ColourSwatch(SwatchColor=RGB(0, 0, 0)), Thickness=Slider(1, range=1..5), Absolute=False)

# ---- group: EXISTING / SHP_RISK_EXISTING
crv_2 = Curve(Tree({0;0;0}: [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], {0;1;0}: [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], {0;2;0}: [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], {0;3;0}: [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], {0;4;0}: [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], {0;5;0}: [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]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))

# ---- group: EXISTING / SHP_VALS_METADATA
data = Data(Tree({0;0}: ["1", "2", "77017.59", "5102703"], {0;1}: ["1", "2", "77017.59", "5102703"], {0;2}: ["1", "2", "77017.59", "5102703"], {0;3}: ["1", "2", "77017.59", "5102703"], {0;4}: ["1", "2", "77017.59", "5102703"], {0;5}: ["1", "2", "77017.59", "5102703"]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))

# ---- group: SHP_RISK_1
crv_3 = Curve([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])

# ---- group: SHP_RISK_2
crv_4 = Curve([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])

# ---- group: SHP_RISK_3
crv_5 = Curve([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])

# ---- group: SHP_RISK_4
crv_6 = Curve([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])

# ---- group: SHP_RISK_5
crv_7 = Curve([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])

# ---- group: SHP_USME URB BDY
crv_8 = Curve(Tree({0;0;0}: [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], {1;0;0}: [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], {2;0;0}: [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], {3;0;0}: [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], {4;0;0}: [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], {5;0;0}: [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], {5;1;0}: [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], {5;2;0}: [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], {5;3;0}: [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], {6;0;0}: [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]))

# ----
entwine = Entwine(Branch00=crv_3, Branch01=crv_4, Branch02=crv_5, Branch03=crv_6, Branch04=crv_7, Branch05=crv_8, FlattenInputs=True)
bang = ExplodeTree(Data=entwine)  # -> Branch0, Branch1, Branch2, Branch3, Branch4, Branch5

# ---- group: EXISTING / USME URB BDY
crv_9 = Curve(crv)

# ----
X = UnitX(Factor=Slider(7000, range=0..100000))

# ---- group: RISK 3
# EXISTING -RISK
swatch = ColourSwatch(SwatchColor=RGB(74, 130, 118))
previewlw_2 = CustomPreviewLineweights(Geometry=bang.Branch0, Shader=swatch, Thickness=Slider(1, range=1..5), Absolute=False)

# ---- group: RISK 4
previewlw_3 = CustomPreviewLineweights(
    Geometry=bang.Branch1,
    Shader=ColourSwatch(SwatchColor=RGB(78, 64, 118)),
    Thickness=Slider(3, range=1..5),
    Absolute=False)

# ---- group: RISK 5
previewlw_4 = CustomPreviewLineweights(
    Geometry=bang.Branch2,
    Shader=ColourSwatch(SwatchColor=RGB(187, 0, 118)),
    Thickness=Slider(3, range=1..5),
    Absolute=False)

# ----
brec = BoundingRectangle(Geometry=flatten(entwine), Plane=PlaneXY(0, 0, 0), Axis=0, Slide=0, Union=True)  # -> Bounding, DimensionX, DimensionY

# ---- group: BOUNDING_RECTANGLE
srf = Surface(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)

# ---- group: TAG
offset = OffsetCurve(Curve=srf, Distance=Slider(638, range=0..10000), Corners=1)
explode = Explode(Curve=offset, Recursive=True)  # -> Segments, Vertices
midpt = CurveMiddle(Curve=explode.Segments)
pdecon = Deconstruct(Point=midpt)  # -> XComponent, YComponent, ZComponent
sort = SortList(Keys=pdecon.YComponent, ValuesA=explode.Segments)  # -> Keys, ValuesA
item = ListItem(List=sort.ValuesA, Index=0, Wrap=True)  # -> Item1, Item
dash = DashPattern(Curve=srf, Pattern=Slider(201, range=0..500))  # -> Dashes, Gaps
curvepoint = PointOnCurve(item.Item1, parameter=0.591)
tag = TextTag(Location=curvepoint, Text="EXISTING RISK MAP")
previewlw_5 = CustomPreviewLineweights(Geometry=dash.Dashes, Shader=ColourSwatch(SwatchColor=RGB(255, 255, 255)), Thickness="2", Absolute=False)

# ----
number_slider = Slider(100, range=0..200)
srf_2 = Surface(srf)
mesh_uv = MeshSurface(Surface=srf_2, UCount=number_slider, VCount=number_slider, Overhang=True, Equalize=False)
facen = FaceNormals(Mesh=mesh_uv)  # -> Centers, Normals
explode_2 = MeshExplode(Mesh=mesh_uv, Interpolate=False)
pt = Point(facen.Centers)

height = Slider(19, range=0..50)

# ---- group: RH_IN:usmeBdy
toggle = BooleanToggle(True)

# ---- group: BNDNG_RECT
srf_3 = Surface(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)

# ----
average_size_of_retail_commercial_shop_s = Slider(50, range=30..120)  # "Average Size of Retail/Commercial Shop (sq.m)"
no_of_empolyments_per_household_unit = Slider(2, range=1..8)
area_of_public_space_per_inhabitant_sq_m = Slider(13, range=10..15)
residential_unit_size_sq_m = Slider(90, range=30..120)
percentage_of_residential = Slider(60, range=20..80)
rh_in_pspace = GetNumber(
    area_of_public_space_per_inhabitant_sq_m,
    AtLeast=1,
    AtMost=2147483647,
    Maximum=1.797693135e+308,
    Minimum=-1.797693135e+308)
rh_in_resi_percentage = GetNumber(percentage_of_residential, AtLeast=1, AtMost=2147483647, Maximum=1.797693135e+308, Minimum=-1.797693135e+308)
rh_in_resi_size = GetNumber(residential_unit_size_sq_m, AtLeast=1, AtMost=2147483647, Maximum=1.797693135e+308, Minimum=-1.797693135e+308)
rh_in_commercial_size = GetNumber(
    average_size_of_retail_commercial_shop_s,
    AtLeast=1,
    AtMost=2147483647,
    Maximum=1.797693135e+308,
    Minimum=-1.797693135e+308)
rh_in_employment = GetNumber(no_of_empolyments_per_household_unit, AtLeast=1, AtMost=2147483647, Maximum=1.797693135e+308, Minimum=-1.797693135e+308)

# ---- group: SRF
mesh = Mesh(mesh_uv)

# ---- group: LVL5
rgb = ColourRGB(
    Alpha=Slider(255, range=0..255),
    Red=Slider(0, range=0..255),
    Green=Slider(18, range=0..255),
    Blue=Slider(51, range=0..255))

# ---- group: LVL4
rgb_2 = ColourRGB(
    Alpha=Slider(255, range=0..255),
    Red=Slider(51, range=0..255),
    Green=Slider(65, range=0..255),
    Blue=Slider(92, range=0..255))

# ---- group: LVL3
rgb_3 = ColourRGB(
    Alpha=Slider(255, range=0..255),
    Red=Slider(92, range=0..255),
    Green=Slider(103, range=0..255),
    Blue=Slider(125, range=0..255))

# ---- group: LVL2
rgb_4 = ColourRGB(
    Alpha=Slider(255, range=0..255),
    Red=Slider(151, range=0..255),
    Green=Slider(157, range=0..255),
    Blue=Slider(172, range=0..255))

# ----
division = Division(A=rh_in_resi_percentage, B="100")

# ---- group: LVL1
rgb_5 = ColourRGB(
    Alpha=Slider(53, range=0..255),
    Red=Slider(63, range=0..255),
    Green=Slider(64, range=0..255),
    Blue=Slider(65, range=0..255))

# ---- group: CALCULATIONS / EMPLOYMENT X HOUSEHOLD
employment_x_household = Panel(rh_in_employment)
num = Number(employment_x_household)

# ---- group: CALCULATIONS / SIZE RETAIL
avrg_size_retail_shops = Panel(rh_in_commercial_size)
num_2 = Number(avrg_size_retail_shops)

# ---- group: CALCULATIONS / RESI UNIT SIZE
resi_unit_size = Panel(rh_in_resi_size)
num_3 = Number(resi_unit_size)

# ---- group: CALCULATIONS / RESI %
resi_percentage = Panel(division)
num_4 = Number(resi_percentage)

# ---- group: CALCULATIONS / PUBLIC SPACE X INHABITANT
public_space_x_inhabitant = Panel(rh_in_pspace)
num_5 = Number(public_space_x_inhabitant)

# ---- group: LVL2
crv_10 = Curve(bang.Branch1)

# ---- group: LVL3
crv_11 = Curve(bang.Branch2)

# ---- group: LVL4
crv_12 = Curve(bang.Branch3)

# ---- group: LVL5
crv_13 = Curve(bang.Branch4)

# ---- group: LVL1_CRV
crv_14 = Curve(bang.Branch0)

# ---- group: seed
number_slider_2 = Slider(0, range=0..100)

# ----
# EXSITING RISK
swatch_2 = ColourSwatch(SwatchColor=RGB(140, 116, 181))

# ---- group: RH_IN:E_risk5
toggle_2 = BooleanToggle(True)

# ---- group: RH_IN:E_risk3
toggle_3 = BooleanToggle(True)

# ---- group: RH_IN:E_risk4
toggle_4 = BooleanToggle(True)

# ---- group: RH_IN:E_risk2
toggle_5 = BooleanToggle(True)

# ---- group: RH_IN:E_risk1
toggle_6 = BooleanToggle(True)

# ----
X_2 = UnitX(Factor=Slider(5500, range=0..1000000))
Z = UnitZ(Factor=1)

# ---- group: RH_IN:P_risk2
toggle_7 = BooleanToggle(True)

# ---- group: RH_IN:P_risk3
toggle_8 = BooleanToggle(True)

# ---- group: RH_IN:P_risk1
toggle_9 = BooleanToggle(True)

# ---- group: RH_IN:P_risk4
toggle_10 = BooleanToggle(True)

# ---- group: EXISTING
# USME-  INTERVENTION
panel = Panel("1")
item_2 = ListItem(List=data, Index=panel, Wrap=True)  # -> flatten(Item)
panel_2 = Panel(item_2)

# ---- group: EXISTING / CRVS HAZ 3
equals = Equality(FirstNumber=item_2, SecondNumber="3")  # -> Equality, Inequality
cull = CullPattern(List=flatten(crv_2), CullPattern=equals.Equality)
join = JoinCurves(Curves=cull, Preserve=False)

# ---- group: EXISTING / CRVS_HAZ4
equals_2 = Equality(FirstNumber=item_2, SecondNumber="4")  # -> Equality, Inequality
cull_2 = CullPattern(List=flatten(crv_2), CullPattern=equals_2.Equality)
join_2 = JoinCurves(Curves=cull_2, Preserve=False)

# ---- group: EXISTING / CRVS_HAZ5
equals_3 = Equality(FirstNumber=item_2, SecondNumber="5")  # -> Equality, Inequality
cull_3 = CullPattern(List=flatten(crv_2), CullPattern=equals_3.Equality)
join_3 = JoinCurves(Curves=cull_3, Preserve=False)

# ---- group: EXISTING (continued)
crv_15 = Curve(join_3)
crv_16 = Curve(join)
crv_17 = Curve(join_2)
entwine_2 = Entwine(Branch00=crv_16, Branch01=crv_17, Branch02=crv_15, Branch03=crv_9, FlattenInputs=True)
move = Move(Geometry=entwine_2, Motion=X)  # -> Geometry, Transform
bang_2 = ExplodeTree(Data=entwine_2)  # -> Branch0, Branch1, Branch2, Branch3

# ---- group: USME URBAN BOUNDARY
crv_18 = Curve(bang_2.Branch3)

# ---- group: RISK 3
# EXISTING - WEIGHTED SUM HAZARD
swatch_3 = ColourSwatch(SwatchColor=RGB(255, 179, 118))
previewlw_6 = CustomPreviewLineweights(Geometry=bang_2.Branch0, Shader=swatch_3, Thickness=Slider(1, range=1..5), Absolute=False)

# ---- group: RISK 4
previewlw_7 = CustomPreviewLineweights(
    Geometry=bang_2.Branch1,
    Shader=ColourSwatch(SwatchColor=RGB(255, 119, 118)),
    Thickness=Slider(3, range=1..5),
    Absolute=False)

# ---- group: RISK 5
previewlw_8 = CustomPreviewLineweights(
    Geometry=bang_2.Branch2,
    Shader=ColourSwatch(SwatchColor=RGB(245, 10, 118)),
    Thickness=Slider(3, range=1..5),
    Absolute=False)

# ---- group: CRV INSIDE URB BOUNDARY / USME URB BDY
crv_19 = Curve(bang_2.Branch3)

# ----
brec_2 = BoundingRectangle(Geometry=crv_19, Plane=PlaneXY(0, 0, 0), Axis=0, Slide=0, Union=True)  # -> Bounding, DimensionX, DimensionY

# ---- group: USME URBAN BOUNDARY
# USME URB BOUNDARY
crv_20 = Curve(bang.Branch5)
merge = Merge(Data1=crv_18, Data2=crv_20)
Z_2 = UnitZ(Factor=height)
move_2 = Move(Geometry=merge, Motion=Z_2)  # -> Geometry, Transform
join_4 = JoinCurves(Curves=move_2.Geometry, Preserve=False)

# ----
filter = StreamFilter(Gate=toggle, Stream1=crv_20)
panel_3 = Panel(filter)

# ---- group: RH_OUT:usme
crv_21 = Curve(filter)

# ---- group: USME URBAN BOUNDARY (continued)
previewlw_9 = CustomPreviewLineweights(Geometry=crv_21, Shader=ColourSwatch(SwatchColor=RGB(20, 0, 124)), Thickness=Slider(2, range=1..5), Absolute=False)

# ----
panel_4 = Panel(crv_21)

# ---- group: USME URB BDY
crv_22 = Curve(crv_20)

# ---- group: RISK LEVEL 1
facen_2 = FaceNormals(Mesh=mesh)  # -> Centers, Normals
explode_3 = MeshExplode(Mesh=mesh, Interpolate=False)
incurves = PointInCurves(Point=facen_2.Centers, Curves=crv_22)  # -> Relationship, Index, Point
smaller = SmallerThan(FirstNumber="1", SecondNumber=incurves.Relationship)  # -> SmallerThan, OrEqualTo
larger = LargerThan(FirstNumber="1", SecondNumber=incurves.Relationship)  # -> LargerThan, OrEqualTo
cull_4 = CullPattern(List=explode_3, CullPattern=smaller.OrEqualTo)
mesh_2 = Mesh(cull_4)
facen_3 = FaceNormals(Mesh=mesh_2)  # -> flatten(Centers), Normals
incurves_2 = PointInCurves(Point=facen_3.Centers, Curves=crv_14)  # -> Relationship, Index, Point
smaller_2 = SmallerThan(FirstNumber="0", SecondNumber=incurves_2.Relationship)  # -> SmallerThan, OrEqualTo
cull_5 = CullPattern(List=mesh_2, CullPattern=smaller_2.SmallerThan)

# ----
pt_2 = Point(facen_3.Centers)
incurves_3 = PointInCurves(Point=pt_2, Curves=crv_10)  # -> Relationship, Index, Point
smaller_3 = SmallerThan(FirstNumber="0", SecondNumber=incurves_3.Relationship)  # -> SmallerThan, OrEqualTo
cull_6 = CullPattern(List=pt_2, CullPattern=smaller_3.SmallerThan)
cull_7 = CullPattern(List=mesh_2, CullPattern=smaller_3.SmallerThan)
dots = DotDisplay(Point=cull_6, Colour=RGB(255, 0, 0), Size=Slider(15, range=0..20))

pt_3 = Point(pt_2)
incurves_4 = PointInCurves(Point=pt_3, Curves=crv_11)  # -> Relationship, Index, Point
smaller_4 = SmallerThan(FirstNumber="0", SecondNumber=incurves_4.Relationship)  # -> SmallerThan, OrEqualTo
cull_8 = CullPattern(List=pt_3, CullPattern=smaller_4.SmallerThan)
cull_9 = CullPattern(List=mesh_2, CullPattern=smaller_4.SmallerThan)
dots_2 = DotDisplay(Point=cull_8, Colour=swatch_2, Size=Slider(15, range=0..20))

pt_4 = Point(pt_3)
incurves_5 = PointInCurves(Point=pt_4, Curves=crv_12)  # -> Relationship, Index, Point
smaller_5 = SmallerThan(FirstNumber="0", SecondNumber=incurves_5.Relationship)  # -> SmallerThan, OrEqualTo
cull_10 = CullPattern(List=mesh_2, CullPattern=smaller_5.SmallerThan)
cull_11 = CullPattern(List=pt_4, CullPattern=smaller_5.SmallerThan)
mcol = MeshColours(Mesh=cull_10, Colours=rgb_2)
dots_3 = DotDisplay(Point=cull_11, Colour=RGB(255, 0, 0), Size=Slider(15, range=0..20))

pt_5 = Point(pt_4)
incurves_6 = PointInCurves(Point=pt_5, Curves=crv_13)  # -> Relationship, Index, Point
smaller_6 = SmallerThan(FirstNumber="0", SecondNumber=incurves_6.Relationship)  # -> SmallerThan, OrEqualTo
cull_12 = CullPattern(List=pt_5, CullPattern=smaller_6.SmallerThan)
cull_13 = CullPattern(List=mesh_2, CullPattern=smaller_6.SmallerThan)
dots_4 = DotDisplay(Point=cull_12, Colour=RGB(255, 0, 0), Size=Slider(15, range=0..20))

mjoin = MeshJoin(Meshes=cull_5)
mesh_3 = Mesh(cull_5)
crv_23 = Curve(crv_10)
facen_4 = FaceNormals(Mesh=mesh_3)  # -> Centers, Normals
incurves_7 = PointInCurves(Point=flatten(facen_4.Centers), Curves=crv_23)  # -> Relationship, Index, Point
facen_5 = FaceNormals(Mesh=mesh_3)  # -> Centers, Normals
larger_2 = LargerThan(FirstNumber="1", SecondNumber=incurves_7.Relationship)  # -> LargerThan, OrEqualTo
cull_14 = CullPattern(List=mesh_3, CullPattern=larger_2.OrEqualTo)
mcol_2 = MeshColours(Mesh=cull_14, Colours=rgb_5)

mcol_3 = MeshColours(Mesh=cull_13, Colours=rgb)
mcol_4 = MeshColours(Mesh=cull_7, Colours=rgb_4)
mcol_5 = MeshColours(Mesh=cull_9, Colours=rgb_3)
filter_2 = StreamFilter(Gate=toggle_6, Stream1=mcol_2)
filter_3 = StreamFilter(Gate=toggle_5, Stream1=mcol_4)
filter_4 = StreamFilter(Gate=toggle_3, Stream1=mcol_5)
filter_5 = StreamFilter(Gate=toggle_4, Stream1=mcol)
filter_6 = StreamFilter(Gate=toggle_2, Stream1=mcol_3)
mesh_4 = Mesh(filter_2)
mesh_5 = Mesh(filter_3)
mesh_6 = Mesh(filter_4)
mesh_7 = Mesh(filter_5)
mesh_8 = Mesh(filter_6)
c_script = CSharpScript(mesh=mesh_4)  # -> base64Draco; inputs mesh: Mesh
# ---------- c_script: C# ----------
    var options = new Rhino.FileIO.DracoCompressionOptions();
    options.CompressionLevel = 5;
    options.IncludeTextureCoordinates = false;
    options.IncludeVertexColors = false;

    var compressed = Rhino.FileIO.DracoCompression.Compress(mesh, options);
    base64Draco = compressed.ToBase64String();
# ---------- end c_script ----------
c_script_2 = CSharpScript(mesh=mesh_5)  # -> base64Draco; inputs mesh: Mesh; same code as c_script
c_script_3 = CSharpScript(mesh=mesh_6)  # -> base64Draco; inputs mesh: Mesh; same code as c_script
c_script_4 = CSharpScript(mesh=mesh_7)  # -> base64Draco; inputs mesh: Mesh; same code as c_script
c_script_5 = CSharpScript(mesh=mesh_8)  # -> base64Draco; inputs mesh: Mesh; same code as c_script

# ---- group: RH_OUT:E_RISK3
mesh_9 = Mesh(filter_4)

# ---- group: RH_OUT:E_RISK4
mesh_10 = Mesh(filter_5)

# ---- group: RH_OUT:E_RISK5
mesh_11 = Mesh(filter_6)

# ---- group: RH_OUT:E_RISK1
mesh_12 = Mesh(filter_2)

# ---- group: RH_OUT:E_RISK2
mesh_13 = Mesh(filter_3)

# ----
txt = Text(c_script)
txt_2 = Text(c_script_2)
txt_3 = Text(c_script_3)
txt_4 = Text(c_script_4)
txt_5 = Text(c_script_5)
medges = MeshEdges(Mesh=mesh_12)  # -> NakedEdges, InteriorEdges, NonManifoldEdges
medges_2 = MeshEdges(Mesh=mesh_13)  # -> NakedEdges, InteriorEdges, NonManifoldEdges
medges_3 = MeshEdges(Mesh=mesh_9)  # -> NakedEdges, InteriorEdges, NonManifoldEdges
medges_4 = MeshEdges(Mesh=mesh_10)  # -> NakedEdges, InteriorEdges, NonManifoldEdges
medges_5 = MeshEdges(Mesh=mesh_11)  # -> NakedEdges, InteriorEdges, NonManifoldEdges

# ---- group: RH_OUT:E_RISK1_CRV
crv_24 = Curve(medges.NakedEdges)

# ---- group: RH_OUT:E_RISK2_CRV
crv_25 = Curve(medges_2.NakedEdges)

# ---- group: RH_OUT:E_RISK3_CRV
crv_26 = Curve(medges_3.NakedEdges)

# ---- group: RH_OUT:E_RISK4_CRV
crv_27 = Curve(medges_4.NakedEdges)

# ---- group: RH_OUT:E_RISK5_CRV
crv_28 = Curve(medges_5.NakedEdges)

# ---- group: CRV INSIDE URB BOUNDARY
merge_2 = Merge(Data1=bang_2.Branch0, Data2=bang_2.Branch1, Data3=bang_2.Branch2)

# ---- group: CRV INSIDE URB BOUNDARY / RISK LVL3 -5
crv_29 = Curve(merge_2)

# ---- group: CRV INSIDE URB BOUNDARY (continued)
debrep = DeconstructBrep(Brep=crv_29)  # -> Faces, Edges, Vertices
incurves_8 = PointInCurves(Point=debrep.Vertices, Curves=crv_19)  # -> Relationship, Index, Point
larger_3 = LargerThan(FirstNumber=incurves_8.Relationship, SecondNumber="0")  # -> LargerThan, OrEqualTo
cull_15 = CullPattern(List=crv_29, CullPattern=larger_3.LargerThan)

# ---- group: LVL 3-5
crv_30 = Curve(cull_15)
srf_4 = Surface(crv_30)

# ----
mesh_uv_2 = MeshSurface(Surface=srf, UCount=number_slider, VCount=number_slider, Overhang=True, Equalize=False)
facen_6 = FaceNormals(Mesh=mesh_uv_2)  # -> Centers, Normals
explode_4 = MeshExplode(Mesh=mesh_uv_2, Interpolate=False)
pt_6 = Point(facen_6.Centers)
incurves_9 = PointInCurves(Point=pt_6, Curves=flatten(crv_30))  # -> Relationship, Index, Point
smaller_7 = SmallerThan(FirstNumber="0", SecondNumber=incurves_9.Relationship)  # -> SmallerThan, OrEqualTo
cull_16 = CullPattern(List=explode_4, CullPattern=smaller_7.SmallerThan)
area = Area(Geometry=cull_16)  # -> Area, graft(Centroid)

facen_7 = FaceNormals(Mesh=cull_16)  # -> flatten(Centers), Normals
mesh_14 = Mesh(cull_16)
ma = MassAddition(Input=flatten(area.Area))  # -> Result, PartialResults

medges_6 = MeshEdges(Mesh=mesh_14)  # -> NakedEdges, InteriorEdges, NonManifoldEdges
join_5 = JoinCurves(Curves=medges_6.NakedEdges, Preserve=False)
crv_31 = Curve(join_5)

round = Round(Number=ma.Result)  # -> Nearest, Floor, Ceiling
panel_5 = Panel(round.Nearest)

# ---- group: CALCULATIONS
multiplication = Multiplication(A=num_4, B=round.Nearest)
round_2 = Round(Number=multiplication)  # -> Nearest, Floor, Ceiling
division_2 = Division(A=round_2.Nearest, B=num_3)
round_3 = Round(Number=division_2)  # -> Nearest, Floor, Ceiling
residential_units = Panel(round_3.Nearest)
multiplication_2 = Multiplication(A=round_3.Nearest, B="3")
multiplication_3 = Multiplication(A=residential_units, B=num)
multiplication_4 = Multiplication(A=multiplication_2, B=num_5)
jobs = Panel(multiplication_3)
multiplication_5 = Multiplication(A=round_2.Nearest, B="100")
multiplication_6 = Multiplication(A=multiplication_4, B="100")
division_3 = Division(A=multiplication_5, B=round.Nearest)
division_4 = Division(A=multiplication_6, B=round.Nearest)
round_4 = Round(Number=division_3)  # -> Nearest, Floor, Ceiling
multiplication_7 = Multiplication(A=jobs, B=num_2)
multiplication_8 = Multiplication(A=multiplication_7, B="100")
total_area_of_commercial_retail = Panel(multiplication_7)
round_5 = Round(Number=division_4)  # -> Nearest, Floor, Ceiling
division_5 = Division(A=multiplication_8, B=round.Nearest)
round_6 = Round(Number=division_5)  # -> Nearest, Floor, Ceiling
division_6 = Division(A=round.Nearest, B=multiplication_7)
division_7 = Division(A=round.Nearest, B=multiplication_6)
division_8 = Division(A=round.Nearest, B=multiplication_5)
panel_6 = Panel(division_6)
panel_7 = Panel(division_7)
panel_8 = Panel(division_8)

# ----
future_population = Panel(multiplication_2)
area_housing = Panel(round_2.Nearest)
residential_units_2 = Panel(round_3.Nearest)
future_public_space = Panel(multiplication_4)
jobs_2 = Panel(multiplication_3)

subtraction = Subtraction(A=round.Nearest, B=round_2.Nearest)
panel_9 = Panel(subtraction)

# ---- group: CALCULATIONS
percentage_of_residential_2 = Panel(round_4.Nearest)
of_commercial_uses = Panel(round_6.Nearest)
of_public_space = Panel(round_5.Nearest)

# ---- group: INTERVENTION / PUBLIC SPACE / PUBLIC SPACE %
commercial = Number(of_public_space)

# ---- group: INTERVENTION / RESIDENTIAL / RESIDENTIAL %
num_6 = Number(percentage_of_residential_2)

# ----
bang_3 = ExplodeTree(Data=crv_29)  # -> Branch0, Branch1, Branch2

# ---- group: 4
crv_32 = Curve(bang_3.Branch1)

# ---- group: 5
crv_33 = Curve(bang_3.Branch2)

# ---- group: 3
crv_34 = Curve(bang_3.Branch0)

# ---- group: INTERVENTION / COMMERCIAL
commercial_2 = Number(of_commercial_uses)
division_9 = Division(A=commercial_2, B="100")
swatch_4 = ColourSwatch(SwatchColor=RGB(255, 0, 91))

# ---- group: INTERVENTION / PUBLIC SPACE
division_10 = Division(A=commercial, B="100")
swatch_5 = ColourSwatch(SwatchColor=RGB(255, 255, 91))

# ---- group: INTERVENTION / RESIDENTIAL
lng = ListLength(List=facen_7.Centers)
division_11 = Division(A=num_6, B="100")
multiplication_9 = Multiplication(A=lng, B=division_11)
reduce = RandomReduce(List=mesh_14, Reduction=multiplication_9, Seed=number_slider_2)

medges_7 = MeshEdges(Mesh=reduce)  # -> NakedEdges, InteriorEdges, NonManifoldEdges
join_6 = JoinCurves(Curves=medges_7.NakedEdges, Preserve=False)
crv_35 = Curve(join_6)

incurves_10 = PointInCurves(Point=facen_7.Centers, Curves=flatten(crv_35))  # -> Relationship, Index, Point
smaller_8 = SmallerThan(FirstNumber="0", SecondNumber=incurves_10.Relationship)  # -> SmallerThan, OrEqualTo

# ----
dispatch = Dispatch(List=mesh_14, DispatchPattern=smaller_8.SmallerThan)  # -> ListA, ListB

# ---- group: INTERVENTION / RESIDENTIAL (continued)
mesh_15 = Mesh(dispatch.ListB)
mcol_6 = MeshColours(Mesh=mesh_15, Colours=ColourSwatch(SwatchColor=RGBA(0, 0, 255, 252)))

# ---- group: RESIDENTIAL
number_slider_3 = Slider(500, range=0..1000)
dom = ConstructDomain(DomainStart="50", DomainEnd=number_slider_3)
lng_2 = ListLength(List=mcol_6)
random = Random(Range=dom, Number=lng_2, Seed=2)
Z_3 = UnitZ(Factor=random)
move_3 = Move(Geometry=mcol_6, Motion=Z_3)  # -> Geometry, Transform

# ---- group: RH_OUT:residential
mesh_16 = Mesh(move_3.Geometry)

# ---- group: RESIDENTIAL
merge_3 = Merge(Data1=mcol_6)
facen_8 = FaceNormals(Mesh=merge_3)  # -> flatten(Centers), Normals

incurves_11 = PointInCurves(Point=facen_8.Centers, Curves=crv_34)  # -> Relationship, Index, Point
smaller_9 = SmallerThan(FirstNumber="0", SecondNumber=incurves_11.Relationship)  # -> SmallerThan, OrEqualTo
cull_17 = CullPattern(List=merge_3, CullPattern=smaller_9.SmallerThan)

incurves_12 = PointInCurves(Point=facen_8.Centers, Curves=crv_32)  # -> Relationship, Index, Point
smaller_10 = SmallerThan(FirstNumber="0", SecondNumber=incurves_12.Relationship)  # -> SmallerThan, OrEqualTo
cull_18 = CullPattern(List=merge_3, CullPattern=smaller_10.SmallerThan)

incurves_13 = PointInCurves(Point=facen_8.Centers, Curves=crv_33)  # -> Relationship, Index, Point
smaller_11 = SmallerThan(FirstNumber="0", SecondNumber=incurves_13.Relationship)  # -> SmallerThan, OrEqualTo
cull_19 = CullPattern(List=merge_3, CullPattern=smaller_11.SmallerThan)

# ---- group: INTERVENTION / COMMERCIAL (continued)
mesh_17 = Mesh(dispatch.ListA)
lng_3 = ListLength(List=mesh_17)
multiplication_10 = Multiplication(A=lng_3, B=division_9)
facen_9 = FaceNormals(Mesh=mesh_17)  # -> Centers, Normals
reduce_2 = RandomReduce(List=mesh_17, Reduction=multiplication_10, Seed=number_slider_2)
medges_8 = MeshEdges(Mesh=reduce_2)  # -> NakedEdges, InteriorEdges, NonManifoldEdges
join_7 = JoinCurves(Curves=medges_8.NakedEdges, Preserve=False)
crv_36 = Curve(join_7)
incurves_14 = PointInCurves(Point=flatten(facen_9.Centers), Curves=flatten(crv_36))  # -> Relationship, Index, Point
smaller_12 = SmallerThan(FirstNumber="0", SecondNumber=incurves_14.Relationship)  # -> SmallerThan, OrEqualTo

# ----
dispatch_2 = Dispatch(List=mesh_17, DispatchPattern=smaller_12.SmallerThan)  # -> ListA, ListB
data_2 = Data(dispatch_2.ListA)
data_3 = Data(dispatch_2.ListB)

# ---- group: INTERVENTION / COMMERCIAL (continued)
mesh_18 = Mesh(dispatch_2.ListB)

# ---- group: INTERVENTION / PUBLIC SPACE (continued)
mesh_19 = Mesh(dispatch_2.ListB)
lng_4 = ListLength(List=mesh_19)
multiplication_11 = Multiplication(A=lng_4, B=division_10)
facen_10 = FaceNormals(Mesh=mesh_19)  # -> Centers, Normals
reduce_3 = RandomReduce(List=mesh_19, Reduction=multiplication_11, Seed=number_slider_2)
medges_9 = MeshEdges(Mesh=reduce_3)  # -> NakedEdges, InteriorEdges, NonManifoldEdges
join_8 = JoinCurves(Curves=medges_9.NakedEdges, Preserve=False)
crv_37 = Curve(join_8)
incurves_15 = PointInCurves(Point=flatten(facen_10.Centers), Curves=flatten(crv_37))  # -> Relationship, Index, Point
smaller_13 = SmallerThan(FirstNumber="0", SecondNumber=incurves_15.Relationship)  # -> SmallerThan, OrEqualTo

# ----
dispatch_3 = Dispatch(List=mesh_19, DispatchPattern=smaller_13.SmallerThan)  # -> ListA, ListB

# ---- group: INTERVENTION / RESIDUAL
mesh_20 = Mesh(dispatch_3.ListA)
mcol_7 = MeshColours(Mesh=mesh_20, Colours=ColourSwatch(SwatchColor=RGB(68, 255, 91)))

# ---- group: INTERVENTION / PUBLIC SPACE (continued)
mesh_21 = Mesh(dispatch_3.ListB)

# ---- group: INTERVENTION
mcol_8 = MeshColours(Mesh=mesh_18, Colours=swatch_4)
mcol_9 = MeshColours(Mesh=mesh_21, Colours=swatch_5)

# ---- group: COMMERCIAL
dom_2 = ConstructDomain(DomainStart="50", DomainEnd=expr("X+100", number_slider_3))
lng_5 = ListLength(List=mcol_8)
random_2 = Random(Range=dom_2, Number=lng_5, Seed=2)
Z_4 = UnitZ(Factor=random_2)
move_4 = Move(Geometry=mcol_8, Motion=Z_4)  # -> Geometry, Transform

# ---- group: PUBLIC SPACE
dom_3 = ConstructDomain(DomainStart="50", DomainEnd=expr("X+150", number_slider_3))
lng_6 = ListLength(List=mcol_9)
random_3 = Random(Range=dom_3, Number=lng_6, Seed=2)
Z_5 = UnitZ(Factor=random_3)
move_5 = Move(Geometry=mcol_9, Motion=Z_5)  # -> Geometry, Transform

# ---- group: RESIDUAL
dom_4 = ConstructDomain(DomainStart="50", DomainEnd=number_slider_3)
lng_7 = ListLength(List=mcol_7)
random_4 = Random(Range=dom_4, Number=lng_7, Seed=2)
Z_6 = UnitZ(Factor=random_4)
move_6 = Move(Geometry=mcol_7, Motion=Z_6)  # -> Geometry, Transform

# ---- group: RH_OUT:pspace
mesh_22 = Mesh(move_5.Geometry)

# ---- group: RH_OUT:commercial
mesh_23 = Mesh(move_4.Geometry)

# ---- group: RH_OUT:residual
mesh_24 = Mesh(move_6.Geometry)

# ----
medges_10 = MeshEdges(Mesh=move_4.Geometry)  # -> NakedEdges, InteriorEdges, NonManifoldEdges
medges_11 = MeshEdges(Mesh=move_5.Geometry)  # -> NakedEdges, InteriorEdges, NonManifoldEdges
medges_12 = MeshEdges(Mesh=move_6.Geometry)  # -> NakedEdges, InteriorEdges, NonManifoldEdges
medges_13 = MeshEdges(Mesh=move_3.Geometry)  # -> NakedEdges, InteriorEdges, NonManifoldEdges
facen_11 = FaceNormals(Mesh=mesh_16)  # -> Centers, Normals
facen_12 = FaceNormals(Mesh=mcol_6)  # -> Centers, Normals
ln = Line(StartPoint=flatten(facen_12.Centers), EndPoint=flatten(facen_11.Centers))
facen_13 = FaceNormals(Mesh=mesh_23)  # -> Centers, Normals
facen_14 = FaceNormals(Mesh=mesh_24)  # -> Centers, Normals
facen_15 = FaceNormals(Mesh=mcol_8)  # -> Centers, Normals
facen_16 = FaceNormals(Mesh=mcol_7)  # -> Centers, Normals
facen_17 = FaceNormals(Mesh=mesh_22)  # -> Centers, Normals
facen_18 = FaceNormals(Mesh=mcol_9)  # -> Centers, Normals
merge_4 = Merge(Data1=medges_13.NakedEdges, Data2=ln)
ln_2 = Line(StartPoint=flatten(facen_15.Centers), EndPoint=flatten(facen_13.Centers))
ln_3 = Line(StartPoint=flatten(facen_16.Centers), EndPoint=flatten(facen_14.Centers))
ln_4 = Line(StartPoint=flatten(facen_18.Centers), EndPoint=flatten(facen_17.Centers))
merge_5 = Merge(Data1=medges_10.NakedEdges, Data2=ln_2)
merge_6 = Merge(Data1=medges_11.NakedEdges, Data2=ln_4)
merge_7 = Merge(Data1=medges_12.NakedEdges, Data2=ln_3)

c_script_6 = CSharpScript(mesh=move_3.Geometry)  # -> base64Draco; inputs mesh: Mesh; same code as c_script
c_script_7 = CSharpScript(mesh=move_4.Geometry)  # -> base64Draco; inputs mesh: Mesh; same code as c_script
c_script_8 = CSharpScript(mesh=move_5.Geometry)  # -> base64Draco; inputs mesh: Mesh; same code as c_script
c_script_9 = CSharpScript(mesh=move_6.Geometry)  # -> base64Draco; inputs mesh: Mesh; same code as c_script
txt_6 = Text(c_script_6)
txt_7 = Text(c_script_7)
txt_8 = Text(c_script_8)
txt_9 = Text(c_script_9)

# ---- group: RH_OUT:pspace
crv_38 = Curve(merge_6)

# ---- group: RH_OUT:residential_crv
crv_39 = Curve(merge_4)

# ---- group: RH_OUT:commercial_crv
crv_40 = Curve(merge_5)

# ---- group: RH_OUT:residual
crv_41 = Curve(merge_7)

# ---- group: P_SPACE
merge_8 = Merge(Data1=mcol_9)
facen_19 = FaceNormals(Mesh=merge_8)  # -> flatten(Centers), Normals

# ---- group: COMMERCIAL
merge_9 = Merge(Data1=mcol_8)
facen_20 = FaceNormals(Mesh=merge_9)  # -> flatten(Centers), Normals

# ---- group: LANDSCAPE
merge_10 = Merge(Data1=mcol_7)
facen_21 = FaceNormals(Mesh=merge_10)  # -> flatten(Centers), Normals

# ---- group: P_SPACE
incurves_16 = PointInCurves(Point=facen_19.Centers, Curves=crv_34)  # -> Relationship, Index, Point
smaller_14 = SmallerThan(FirstNumber="0", SecondNumber=incurves_16.Relationship)  # -> SmallerThan, OrEqualTo
cull_20 = CullPattern(List=merge_8, CullPattern=smaller_14.SmallerThan)

incurves_17 = PointInCurves(Point=facen_19.Centers, Curves=crv_32)  # -> Relationship, Index, Point
smaller_15 = SmallerThan(FirstNumber="0", SecondNumber=incurves_17.Relationship)  # -> SmallerThan, OrEqualTo
cull_21 = CullPattern(List=merge_8, CullPattern=smaller_15.SmallerThan)

incurves_18 = PointInCurves(Point=facen_19.Centers, Curves=crv_33)  # -> Relationship, Index, Point
smaller_16 = SmallerThan(FirstNumber="0", SecondNumber=incurves_18.Relationship)  # -> SmallerThan, OrEqualTo
cull_22 = CullPattern(List=merge_8, CullPattern=smaller_16.SmallerThan)

# ---- group: COMMERCIAL
incurves_19 = PointInCurves(Point=facen_20.Centers, Curves=crv_34)  # -> Relationship, Index, Point
smaller_17 = SmallerThan(FirstNumber="0", SecondNumber=incurves_19.Relationship)  # -> SmallerThan, OrEqualTo
cull_23 = CullPattern(List=merge_9, CullPattern=smaller_17.SmallerThan)

incurves_20 = PointInCurves(Point=facen_20.Centers, Curves=crv_32)  # -> Relationship, Index, Point
smaller_18 = SmallerThan(FirstNumber="0", SecondNumber=incurves_20.Relationship)  # -> SmallerThan, OrEqualTo
cull_24 = CullPattern(List=merge_9, CullPattern=smaller_18.SmallerThan)

incurves_21 = PointInCurves(Point=facen_20.Centers, Curves=crv_33)  # -> Relationship, Index, Point
smaller_19 = SmallerThan(FirstNumber="0", SecondNumber=incurves_21.Relationship)  # -> SmallerThan, OrEqualTo
cull_25 = CullPattern(List=merge_9, CullPattern=smaller_19.SmallerThan)

# ---- group: LANDSCAPE
incurves_22 = PointInCurves(Point=facen_21.Centers, Curves=crv_34)  # -> Relationship, Index, Point
smaller_20 = SmallerThan(FirstNumber="0", SecondNumber=incurves_22.Relationship)  # -> SmallerThan, OrEqualTo
cull_26 = CullPattern(List=merge_10, CullPattern=smaller_20.SmallerThan)

incurves_23 = PointInCurves(Point=facen_21.Centers, Curves=crv_32)  # -> Relationship, Index, Point
smaller_21 = SmallerThan(FirstNumber="0", SecondNumber=incurves_23.Relationship)  # -> SmallerThan, OrEqualTo
cull_27 = CullPattern(List=merge_10, CullPattern=smaller_21.SmallerThan)

incurves_24 = PointInCurves(Point=facen_21.Centers, Curves=crv_33)  # -> Relationship, Index, Point
smaller_22 = SmallerThan(FirstNumber="0", SecondNumber=incurves_24.Relationship)  # -> SmallerThan, OrEqualTo
cull_28 = CullPattern(List=merge_10, CullPattern=smaller_22.SmallerThan)

# ---- group: LVL4
merge_11 = Merge(Data1=cull_18, Data2=cull_24, Data3=cull_21, Data4=cull_27)

# ---- group: LVL5
merge_12 = Merge(Data1=cull_19, Data2=cull_25, Data3=cull_22, Data4=cull_28)

# ---- group: LEVEL 3
merge_13 = Merge(Data1=cull_17, Data2=cull_23, Data3=cull_20, Data4=cull_26)

# ---- group: RISK LEVELS
entwine_3 = Entwine(
    Branch00=mesh_12,
    Branch01=mesh_13,
    Branch02=merge_13,
    Branch03=merge_11,
    Branch04=merge_12,
    Branch05=crv_19,
    FlattenInputs=True)

# ----
move_7 = Move(Geometry=entwine_3, Motion=X_2)  # -> Geometry, Transform
bang_4 = ExplodeTree(Data=move_7.Geometry)  # -> Branch0, Branch1, Branch2, Branch3, Branch4, Branch5
merge_14 = Merge(Data1=bang_4.Branch1, Data2=bang_4.Branch2)

# ---- group: EXT_LVL1
mcol_10 = MeshColours(Mesh=bang_4.Branch0, Colours=rgb_5)

# ---- group: PROP_LVL2
mcol_11 = MeshColours(Mesh=merge_14, Colours=rgb_4)  # -> flatten(Mesh)

# ---- group: PROP_LVL2 / PROP_LVL3
mcol_12 = MeshColours(Mesh=bang_4.Branch3, Colours=rgb_3)

# ---- group: PROP_LVL2 / PROP_LVL3 / PROP_LVL4
mcol_13 = MeshColours(Mesh=bang_4.Branch4, Colours=rgb_2)

# ----
filter_7 = StreamFilter(Gate=toggle_7, Stream1=mcol_11)
filter_8 = StreamFilter(Gate=toggle_8, Stream1=mcol_12)
filter_9 = StreamFilter(Gate=toggle_9, Stream1=mcol_10)
filter_10 = StreamFilter(Gate=toggle_10, Stream1=mcol_13)

# ---- group: RH_OUT:prop_lvl_2
mesh_25 = Mesh(filter_7)

# ---- group: RH_OUT:prop_lvl_3
mesh_26 = Mesh(filter_8)

# ---- group: RH_OUT:prop_lvl_4
mesh_27 = Mesh(filter_10)

# ---- group: RH_OUT:usme_bdy
crv_42 = Curve(bang_4.Branch5)

# ----
c_script_10 = CSharpScript(mesh=filter_10)  # -> base64Draco; inputs mesh: Mesh; same code as c_script
c_script_11 = CSharpScript(mesh=filter_7)  # -> base64Draco; inputs mesh: Mesh; same code as c_script
c_script_12 = CSharpScript(mesh=filter_8)  # -> base64Draco; inputs mesh: Mesh; same code as c_script

c_script_13 = CSharpScript(mesh=filter_9)  # -> base64Draco; inputs mesh: Mesh; same code as c_script
txt_10 = Text(c_script_13)
txt_11 = Text(c_script_11)
txt_12 = Text(c_script_12)
txt_13 = Text(c_script_10)

# ---- group: RH_OUT:prop_lvl_1
mesh_28 = Mesh(filter_9)
