# Grasshopper definition NOW_AI_test1.gh (Grasshopper 1.0.7)
# plug-ins: Human

crv = Curve([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])

# ---- group: USME URBAN BOUNDARY
crv_2 = Curve([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])

# ----
height = Slider(19, range=0..50)

# ---- group: CRV INSIDE URB BOUNDARY / RISK LVL3 -5
crv_3 = Curve(Tree({0;0}: [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], {0;1}: [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], {0;2}: [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]))

# ---- group: RH_IN:usmeBdy
toggle = BooleanToggle(True)

# ---- group: CRV INSIDE URB BOUNDARY / USME URB BDY
crv_4 = Curve(crv)

# ----
average_size_of_retail_commercial_shop_s = Slider(50, range=30..120)  # "Average Size of Retail/Commercial Shop (sq.m)"
no_of_empolyments_per_household_unit = Slider(2, range=1..8)
area_of_public_space_per_inhabitant_sq_m = Slider(13, range=10..15)
residential_unit_size_sq_m = Slider(90, range=30..120)
percentage_of_residential = Slider(60, range=20..80)
rh_in_pspace = GetNumber(
    area_of_public_space_per_inhabitant_sq_m,
    AtLeast=1,
    AtMost=2147483647,
    Maximum=1.797693135e+308,
    Minimum=-1.797693135e+308)
rh_in_resi_percentage = GetNumber(percentage_of_residential, AtLeast=1, AtMost=2147483647, Maximum=1.797693135e+308, Minimum=-1.797693135e+308)
rh_in_resi_size = GetNumber(residential_unit_size_sq_m, AtLeast=1, AtMost=2147483647, Maximum=1.797693135e+308, Minimum=-1.797693135e+308)
rh_in_commercial_size = GetNumber(
    average_size_of_retail_commercial_shop_s,
    AtLeast=1,
    AtMost=2147483647,
    Maximum=1.797693135e+308,
    Minimum=-1.797693135e+308)
rh_in_employment = GetNumber(no_of_empolyments_per_household_unit, AtLeast=1, AtMost=2147483647, Maximum=1.797693135e+308, Minimum=-1.797693135e+308)
mesh = Mesh([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])
area = Area(Geometry=mesh)  # -> Area, graft(Centroid)
facen = FaceNormals(Mesh=mesh)  # -> flatten(Centers), Normals
mesh_2 = Mesh(mesh)
ma = MassAddition(Input=flatten(area.Area))  # -> Result, PartialResults

# ---- group: LVL5
rgb = ColourRGB(
    Alpha=Slider(255, range=0..255),
    Red=Slider(0, range=0..255),
    Green=Slider(18, range=0..255),
    Blue=Slider(51, range=0..255))

# ----
medges = MeshEdges(Mesh=mesh_2)  # -> NakedEdges, InteriorEdges, NonManifoldEdges
join = JoinCurves(Curves=medges.NakedEdges, Preserve=False)
crv_5 = Curve(join)

# ---- group: LVL4
rgb_2 = ColourRGB(
    Alpha=Slider(255, range=0..255),
    Red=Slider(51, range=0..255),
    Green=Slider(65, range=0..255),
    Blue=Slider(92, range=0..255))

# ---- group: LVL3
rgb_3 = ColourRGB(
    Alpha=Slider(255, range=0..255),
    Red=Slider(92, range=0..255),
    Green=Slider(103, range=0..255),
    Blue=Slider(125, range=0..255))

# ---- group: LVL2
rgb_4 = ColourRGB(
    Alpha=Slider(255, range=0..255),
    Red=Slider(151, range=0..255),
    Green=Slider(157, range=0..255),
    Blue=Slider(172, range=0..255))

# ----
division = Division(A=rh_in_resi_percentage, B="100")

# ---- group: LVL1
rgb_5 = ColourRGB(
    Alpha=Slider(53, range=0..255),
    Red=Slider(63, range=0..255),
    Green=Slider(64, range=0..255),
    Blue=Slider(65, range=0..255))

# ----
round = Round(Number=ma.Result)  # -> Nearest, Floor, Ceiling

# ---- group: CALCULATIONS / EMPLOYMENT X HOUSEHOLD
employment_x_household = Panel(rh_in_employment)
num = Number(employment_x_household)

# ---- group: CALCULATIONS / SIZE RETAIL
avrg_size_retail_shops = Panel(rh_in_commercial_size)
num_2 = Number(avrg_size_retail_shops)

# ---- group: CALCULATIONS / RESI UNIT SIZE
resi_unit_size = Panel(rh_in_resi_size)
num_3 = Number(resi_unit_size)

# ---- group: CALCULATIONS / RESI %
resi_percentage = Panel(division)
num_4 = Number(resi_percentage)

# ---- group: CALCULATIONS / PUBLIC SPACE X INHABITANT
public_space_x_inhabitant = Panel(rh_in_pspace)
num_5 = Number(public_space_x_inhabitant)

# ----
panel = Panel(round.Nearest)

# ---- group: CALCULATIONS
multiplication = Multiplication(A=num_4, B=round.Nearest)
round_2 = Round(Number=multiplication)  # -> Nearest, Floor, Ceiling
division_2 = Division(A=round_2.Nearest, B=num_3)
round_3 = Round(Number=division_2)  # -> Nearest, Floor, Ceiling
residential_units = Panel(round_3.Nearest)
multiplication_2 = Multiplication(A=round_3.Nearest, B="3")
multiplication_3 = Multiplication(A=residential_units, B=num)
multiplication_4 = Multiplication(A=multiplication_2, B=num_5)
jobs = Panel(multiplication_3)
multiplication_5 = Multiplication(A=round_2.Nearest, B="100")
multiplication_6 = Multiplication(A=multiplication_4, B="100")
division_3 = Division(A=multiplication_5, B=round.Nearest)
division_4 = Division(A=multiplication_6, B=round.Nearest)
round_4 = Round(Number=division_3)  # -> Nearest, Floor, Ceiling
multiplication_7 = Multiplication(A=jobs, B=num_2)
multiplication_8 = Multiplication(A=multiplication_7, B="100")
total_area_of_commercial_retail = Panel(multiplication_7)
round_5 = Round(Number=division_4)  # -> Nearest, Floor, Ceiling
division_5 = Division(A=multiplication_8, B=round.Nearest)
round_6 = Round(Number=division_5)  # -> Nearest, Floor, Ceiling
division_6 = Division(A=round.Nearest, B=multiplication_7)
division_7 = Division(A=round.Nearest, B=multiplication_6)
division_8 = Division(A=round.Nearest, B=multiplication_5)
panel_2 = Panel(division_6)
panel_3 = Panel(division_7)
panel_4 = Panel(division_8)

# ----
future_population = Panel(multiplication_2)
area_housing = Panel(round_2.Nearest)
residential_units_2 = Panel(round_3.Nearest)
future_public_space = Panel(multiplication_4)
jobs_2 = Panel(multiplication_3)

# ---- group: seed
number_slider = Slider(0, range=0..100)

# ----
subtraction = Subtraction(A=round.Nearest, B=round_2.Nearest)
panel_5 = Panel(subtraction)

mesh_3 = Mesh([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])
mcol = MeshColours(Mesh=mesh_3, Colours=rgb)

mesh_4 = Mesh([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])
mesh_5 = Mesh([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])
mesh_6 = Mesh([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])
mesh_7 = Mesh([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])

mcol_2 = MeshColours(Mesh=mesh_6, Colours=rgb_2)
mcol_3 = MeshColours(Mesh=mesh_7, Colours=rgb_5)

mcol_4 = MeshColours(Mesh=mesh_4, Colours=rgb_4)
mcol_5 = MeshColours(Mesh=mesh_5, Colours=rgb_3)

# ---- group: CALCULATIONS
percentage_of_residential_2 = Panel(round_4.Nearest)
of_commercial_uses = Panel(round_6.Nearest)
of_public_space = Panel(round_5.Nearest)

# ---- group: INTERVENTION / PUBLIC SPACE / PUBLIC SPACE %
commercial = Number(of_public_space)

# ---- group: INTERVENTION / RESIDENTIAL / RESIDENTIAL %
num_6 = Number(percentage_of_residential_2)

# ---- group: RH_IN:E_risk5
toggle_2 = BooleanToggle(True)

# ---- group: RH_IN:E_risk3
toggle_3 = BooleanToggle(True)

# ---- group: RH_IN:E_risk4
toggle_4 = BooleanToggle(True)

# ---- group: RH_IN:E_risk2
toggle_5 = BooleanToggle(True)

# ---- group: RH_IN:E_risk1
toggle_6 = BooleanToggle(True)

# ----
filter = StreamFilter(Gate=toggle_6, Stream1=mcol_3)
filter_2 = StreamFilter(Gate=toggle_5, Stream1=mcol_4)
filter_3 = StreamFilter(Gate=toggle_3, Stream1=mcol_5)
filter_4 = StreamFilter(Gate=toggle_4, Stream1=mcol_2)
filter_5 = StreamFilter(Gate=toggle_2, Stream1=mcol)
mesh_8 = Mesh(filter)
mesh_9 = Mesh(filter_2)
mesh_10 = Mesh(filter_3)
mesh_11 = Mesh(filter_4)
mesh_12 = Mesh(filter_5)
c_script = CSharpScript(mesh=mesh_8)  # -> base64Draco; inputs mesh: Mesh
# ---------- c_script: C# ----------
    var options = new Rhino.FileIO.DracoCompressionOptions();
    options.CompressionLevel = 5;
    options.IncludeTextureCoordinates = false;
    options.IncludeVertexColors = false;

    var compressed = Rhino.FileIO.DracoCompression.Compress(mesh, options);
    base64Draco = compressed.ToBase64String();
# ---------- end c_script ----------
c_script_2 = CSharpScript(mesh=mesh_9)  # -> base64Draco; inputs mesh: Mesh; same code as c_script
c_script_3 = CSharpScript(mesh=mesh_10)  # -> base64Draco; inputs mesh: Mesh; same code as c_script
c_script_4 = CSharpScript(mesh=mesh_11)  # -> base64Draco; inputs mesh: Mesh; same code as c_script
c_script_5 = CSharpScript(mesh=mesh_12)  # -> base64Draco; inputs mesh: Mesh; same code as c_script

# ---- group: RH_OUT:E_RISK3
mesh_13 = Mesh(filter_3)

# ---- group: RH_OUT:E_RISK4
mesh_14 = Mesh(filter_4)

# ---- group: RH_OUT:E_RISK5
mesh_15 = Mesh(filter_5)

# ---- group: RH_OUT:E_RISK1
mesh_16 = Mesh(filter)

# ---- group: RH_OUT:E_RISK2
mesh_17 = Mesh(filter_2)

# ---- group: RH_OUT:E_RISK1_CRV
txt = Text(c_script)

# ---- group: RH_OUT:E_RISK2_CRV
txt_2 = Text(c_script_2)

# ---- group: RH_OUT:E_RISK3_CRV
txt_3 = Text(c_script_3)

# ---- group: RH_OUT:E_RISK4_CRV
txt_4 = Text(c_script_4)

# ---- group: RH_OUT:E_RISK5_CRV
txt_5 = Text(c_script_5)

# ----
medges_2 = MeshEdges(Mesh=mesh_16)  # -> NakedEdges, InteriorEdges, NonManifoldEdges
medges_3 = MeshEdges(Mesh=mesh_17)  # -> NakedEdges, InteriorEdges, NonManifoldEdges
medges_4 = MeshEdges(Mesh=mesh_13)  # -> NakedEdges, InteriorEdges, NonManifoldEdges
medges_5 = MeshEdges(Mesh=mesh_14)  # -> NakedEdges, InteriorEdges, NonManifoldEdges
medges_6 = MeshEdges(Mesh=mesh_15)  # -> NakedEdges, InteriorEdges, NonManifoldEdges
crv_6 = Curve(medges_2.NakedEdges)
crv_7 = Curve(medges_3.NakedEdges)
crv_8 = Curve(medges_4.NakedEdges)
crv_9 = Curve(medges_5.NakedEdges)
crv_10 = Curve(medges_6.NakedEdges)
bang = ExplodeTree(Data=crv_3)  # -> Branch0, Branch1, Branch2

# ---- group: 4
crv_11 = Curve(bang.Branch1)

# ---- group: 5
crv_12 = Curve(bang.Branch2)

# ---- group: 3
crv_13 = Curve(bang.Branch0)

# ----
X = UnitX(Factor=Slider(5500, range=0..1000000))
Z = UnitZ(Factor=1)

# ---- group: RH_IN:P_risk2
toggle_7 = BooleanToggle(True)

# ---- group: RH_IN:P_risk3
toggle_8 = BooleanToggle(True)

# ---- group: RH_IN:P_risk1
toggle_9 = BooleanToggle(True)

# ---- group: RH_IN:P_risk4
toggle_10 = BooleanToggle(True)

# ---- group: USME URBAN BOUNDARY
# USME URB BOUNDARY
crv_14 = Curve([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])
merge = Merge(Data1=crv_2, Data2=crv_14)
Z_2 = UnitZ(Factor=height)
move = Move(Geometry=merge, Motion=Z_2)  # -> Geometry, Transform
join_2 = JoinCurves(Curves=move.Geometry, Preserve=False)

# ----
filter_6 = StreamFilter(Gate=toggle, Stream1=crv_14)
panel_6 = Panel(filter_6)

# ---- group: RH_OUT:usme
crv_15 = Curve(filter_6)

# ---- group: USME URBAN BOUNDARY (continued)
previewlw = CustomPreviewLineweights(Geometry=crv_15, Shader=ColourSwatch(SwatchColor=RGB(20, 0, 124)), Thickness=Slider(2, range=1..5), Absolute=False)

# ----
panel_7 = Panel(crv_15)

# ---- group: INTERVENTION / COMMERCIAL
commercial_2 = Number(of_commercial_uses)
division_9 = Division(A=commercial_2, B="100")
swatch = ColourSwatch(SwatchColor=RGB(255, 0, 91))

# ---- group: INTERVENTION / PUBLIC SPACE
division_10 = Division(A=commercial, B="100")
swatch_2 = ColourSwatch(SwatchColor=RGB(255, 255, 91))

# ---- group: INTERVENTION / RESIDENTIAL
lng = ListLength(List=facen.Centers)
division_11 = Division(A=num_6, B="100")
multiplication_9 = Multiplication(A=lng, B=division_11)
reduce = RandomReduce(List=mesh_2, Reduction=multiplication_9, Seed=number_slider)

medges_7 = MeshEdges(Mesh=reduce)  # -> NakedEdges, InteriorEdges, NonManifoldEdges
join_3 = JoinCurves(Curves=medges_7.NakedEdges, Preserve=False)
crv_16 = Curve(join_3)

incurves = PointInCurves(Point=facen.Centers, Curves=flatten(crv_16))  # -> Relationship, Index, Point
smaller = SmallerThan(FirstNumber="0", SecondNumber=incurves.Relationship)  # -> SmallerThan, OrEqualTo

# ----
dispatch = Dispatch(List=mesh_2, DispatchPattern=smaller.SmallerThan)  # -> ListA, ListB

# ---- group: INTERVENTION / RESIDENTIAL (continued)
mesh_18 = Mesh(dispatch.ListB)
mcol_6 = MeshColours(Mesh=mesh_18, Colours=ColourSwatch(SwatchColor=RGBA(0, 0, 255, 252)))

# ---- group: RESIDENTIAL
number_slider_2 = Slider(500, range=0..1000)
dom = ConstructDomain(DomainStart="50", DomainEnd=number_slider_2)
lng_2 = ListLength(List=mcol_6)
random = Random(Range=dom, Number=lng_2, Seed=2)
Z_3 = UnitZ(Factor=random)
move_2 = Move(Geometry=mcol_6, Motion=Z_3)  # -> Geometry, Transform

merge_2 = Merge(Data1=mcol_6)
facen_2 = FaceNormals(Mesh=merge_2)  # -> flatten(Centers), Normals

incurves_2 = PointInCurves(Point=facen_2.Centers, Curves=crv_13)  # -> Relationship, Index, Point
smaller_2 = SmallerThan(FirstNumber="0", SecondNumber=incurves_2.Relationship)  # -> SmallerThan, OrEqualTo
cull = CullPattern(List=merge_2, CullPattern=smaller_2.SmallerThan)

incurves_3 = PointInCurves(Point=facen_2.Centers, Curves=crv_11)  # -> Relationship, Index, Point
smaller_3 = SmallerThan(FirstNumber="0", SecondNumber=incurves_3.Relationship)  # -> SmallerThan, OrEqualTo
cull_2 = CullPattern(List=merge_2, CullPattern=smaller_3.SmallerThan)

incurves_4 = PointInCurves(Point=facen_2.Centers, Curves=crv_12)  # -> Relationship, Index, Point
smaller_4 = SmallerThan(FirstNumber="0", SecondNumber=incurves_4.Relationship)  # -> SmallerThan, OrEqualTo
cull_3 = CullPattern(List=merge_2, CullPattern=smaller_4.SmallerThan)

# ---- group: INTERVENTION / COMMERCIAL (continued)
mesh_19 = Mesh(dispatch.ListA)
lng_3 = ListLength(List=mesh_19)
multiplication_10 = Multiplication(A=lng_3, B=division_9)
facen_3 = FaceNormals(Mesh=mesh_19)  # -> Centers, Normals
reduce_2 = RandomReduce(List=mesh_19, Reduction=multiplication_10, Seed=number_slider)
medges_8 = MeshEdges(Mesh=reduce_2)  # -> NakedEdges, InteriorEdges, NonManifoldEdges
join_4 = JoinCurves(Curves=medges_8.NakedEdges, Preserve=False)
crv_17 = Curve(join_4)
incurves_5 = PointInCurves(Point=flatten(facen_3.Centers), Curves=flatten(crv_17))  # -> Relationship, Index, Point
smaller_5 = SmallerThan(FirstNumber="0", SecondNumber=incurves_5.Relationship)  # -> SmallerThan, OrEqualTo

# ----
dispatch_2 = Dispatch(List=mesh_19, DispatchPattern=smaller_5.SmallerThan)  # -> ListA, ListB
data = Data(dispatch_2.ListA)
data_2 = Data(dispatch_2.ListB)

# ---- group: INTERVENTION / COMMERCIAL (continued)
mesh_20 = Mesh(dispatch_2.ListB)

# ---- group: INTERVENTION / PUBLIC SPACE (continued)
mesh_21 = Mesh(dispatch_2.ListB)
lng_4 = ListLength(List=mesh_21)
multiplication_11 = Multiplication(A=lng_4, B=division_10)
facen_4 = FaceNormals(Mesh=mesh_21)  # -> Centers, Normals
reduce_3 = RandomReduce(List=mesh_21, Reduction=multiplication_11, Seed=number_slider)
medges_9 = MeshEdges(Mesh=reduce_3)  # -> NakedEdges, InteriorEdges, NonManifoldEdges
join_5 = JoinCurves(Curves=medges_9.NakedEdges, Preserve=False)
crv_18 = Curve(join_5)
incurves_6 = PointInCurves(Point=flatten(facen_4.Centers), Curves=flatten(crv_18))  # -> Relationship, Index, Point
smaller_6 = SmallerThan(FirstNumber="0", SecondNumber=incurves_6.Relationship)  # -> SmallerThan, OrEqualTo

# ----
dispatch_3 = Dispatch(List=mesh_21, DispatchPattern=smaller_6.SmallerThan)  # -> ListA, ListB

# ---- group: INTERVENTION / RESIDUAL
mesh_22 = Mesh(dispatch_3.ListA)
mcol_7 = MeshColours(Mesh=mesh_22, Colours=ColourSwatch(SwatchColor=RGB(68, 255, 91)))

# ---- group: INTERVENTION / PUBLIC SPACE (continued)
mesh_23 = Mesh(dispatch_3.ListB)

# ---- group: INTERVENTION
mcol_8 = MeshColours(Mesh=mesh_20, Colours=swatch)
mcol_9 = MeshColours(Mesh=mesh_23, Colours=swatch_2)

# ---- group: COMMERCIAL
dom_2 = ConstructDomain(DomainStart="50", DomainEnd=expr("X+100", number_slider_2))
lng_5 = ListLength(List=mcol_8)
random_2 = Random(Range=dom_2, Number=lng_5, Seed=2)
Z_4 = UnitZ(Factor=random_2)
move_3 = Move(Geometry=mcol_8, Motion=Z_4)  # -> Geometry, Transform

# ---- group: PUBLIC SPACE
dom_3 = ConstructDomain(DomainStart="50", DomainEnd=expr("X+150", number_slider_2))
lng_6 = ListLength(List=mcol_9)
random_3 = Random(Range=dom_3, Number=lng_6, Seed=2)
Z_5 = UnitZ(Factor=random_3)
move_4 = Move(Geometry=mcol_9, Motion=Z_5)  # -> Geometry, Transform

# ---- group: RESIDUAL
dom_4 = ConstructDomain(DomainStart="50", DomainEnd=number_slider_2)
lng_7 = ListLength(List=mcol_7)
random_4 = Random(Range=dom_4, Number=lng_7, Seed=2)
Z_6 = UnitZ(Factor=random_4)
move_5 = Move(Geometry=mcol_7, Motion=Z_6)  # -> Geometry, Transform

# ----
medges_10 = MeshEdges(Mesh=move_3.Geometry)  # -> NakedEdges, InteriorEdges, NonManifoldEdges
medges_11 = MeshEdges(Mesh=move_4.Geometry)  # -> NakedEdges, InteriorEdges, NonManifoldEdges
medges_12 = MeshEdges(Mesh=move_5.Geometry)  # -> NakedEdges, InteriorEdges, NonManifoldEdges
medges_13 = MeshEdges(Mesh=move_2.Geometry)  # -> NakedEdges, InteriorEdges, NonManifoldEdges
mesh_24 = Mesh(move_2.Geometry)
mesh_25 = Mesh(move_4.Geometry)
mesh_26 = Mesh(move_3.Geometry)
mesh_27 = Mesh(move_5.Geometry)
facen_5 = FaceNormals(Mesh=mesh_24)  # -> Centers, Normals
facen_6 = FaceNormals(Mesh=mcol_6)  # -> Centers, Normals
ln = Line(StartPoint=flatten(facen_6.Centers), EndPoint=flatten(facen_5.Centers))
facen_7 = FaceNormals(Mesh=mesh_26)  # -> Centers, Normals
facen_8 = FaceNormals(Mesh=mesh_27)  # -> Centers, Normals
facen_9 = FaceNormals(Mesh=mcol_8)  # -> Centers, Normals
facen_10 = FaceNormals(Mesh=mcol_7)  # -> Centers, Normals
facen_11 = FaceNormals(Mesh=mesh_25)  # -> Centers, Normals
facen_12 = FaceNormals(Mesh=mcol_9)  # -> Centers, Normals
merge_3 = Merge(Data1=medges_13.NakedEdges, Data2=ln)
ln_2 = Line(StartPoint=flatten(facen_9.Centers), EndPoint=flatten(facen_7.Centers))
ln_3 = Line(StartPoint=flatten(facen_10.Centers), EndPoint=flatten(facen_8.Centers))
ln_4 = Line(StartPoint=flatten(facen_12.Centers), EndPoint=flatten(facen_11.Centers))
merge_4 = Merge(Data1=medges_10.NakedEdges, Data2=ln_2)
merge_5 = Merge(Data1=medges_11.NakedEdges, Data2=ln_4)
merge_6 = Merge(Data1=medges_12.NakedEdges, Data2=ln_3)

c_script_6 = CSharpScript(mesh=move_2.Geometry)  # -> base64Draco; inputs mesh: Mesh; same code as c_script
c_script_7 = CSharpScript(mesh=move_3.Geometry)  # -> base64Draco; inputs mesh: Mesh; same code as c_script
c_script_8 = CSharpScript(mesh=move_4.Geometry)  # -> base64Draco; inputs mesh: Mesh; same code as c_script
c_script_9 = CSharpScript(mesh=move_5.Geometry)  # -> base64Draco; inputs mesh: Mesh; same code as c_script

# ---- group: RH_OUT:residential
txt_6 = Text(c_script_6)

# ---- group: RH_OUT:commercial
txt_7 = Text(c_script_7)

# ---- group: RH_OUT:pspace
txt_8 = Text(c_script_8)

# ---- group: RH_OUT:residual
txt_9 = Text(c_script_9)

# ---- group: RH_OUT:pspace
crv_19 = Curve(merge_5)

# ---- group: RH_OUT:residential_crv
crv_20 = Curve(merge_3)

# ---- group: RH_OUT:commercial_crv
crv_21 = Curve(merge_4)

# ---- group: RH_OUT:residual
crv_22 = Curve(merge_6)

# ---- group: P_SPACE
merge_7 = Merge(Data1=mcol_9)
facen_13 = FaceNormals(Mesh=merge_7)  # -> flatten(Centers), Normals

# ---- group: COMMERCIAL
merge_8 = Merge(Data1=mcol_8)
facen_14 = FaceNormals(Mesh=merge_8)  # -> flatten(Centers), Normals

# ---- group: LANDSCAPE
merge_9 = Merge(Data1=mcol_7)
facen_15 = FaceNormals(Mesh=merge_9)  # -> flatten(Centers), Normals

# ---- group: P_SPACE
incurves_7 = PointInCurves(Point=facen_13.Centers, Curves=crv_13)  # -> Relationship, Index, Point
smaller_7 = SmallerThan(FirstNumber="0", SecondNumber=incurves_7.Relationship)  # -> SmallerThan, OrEqualTo
cull_4 = CullPattern(List=merge_7, CullPattern=smaller_7.SmallerThan)

incurves_8 = PointInCurves(Point=facen_13.Centers, Curves=crv_11)  # -> Relationship, Index, Point
smaller_8 = SmallerThan(FirstNumber="0", SecondNumber=incurves_8.Relationship)  # -> SmallerThan, OrEqualTo
cull_5 = CullPattern(List=merge_7, CullPattern=smaller_8.SmallerThan)

incurves_9 = PointInCurves(Point=facen_13.Centers, Curves=crv_12)  # -> Relationship, Index, Point
smaller_9 = SmallerThan(FirstNumber="0", SecondNumber=incurves_9.Relationship)  # -> SmallerThan, OrEqualTo
cull_6 = CullPattern(List=merge_7, CullPattern=smaller_9.SmallerThan)

# ---- group: COMMERCIAL
incurves_10 = PointInCurves(Point=facen_14.Centers, Curves=crv_13)  # -> Relationship, Index, Point
smaller_10 = SmallerThan(FirstNumber="0", SecondNumber=incurves_10.Relationship)  # -> SmallerThan, OrEqualTo
cull_7 = CullPattern(List=merge_8, CullPattern=smaller_10.SmallerThan)

incurves_11 = PointInCurves(Point=facen_14.Centers, Curves=crv_11)  # -> Relationship, Index, Point
smaller_11 = SmallerThan(FirstNumber="0", SecondNumber=incurves_11.Relationship)  # -> SmallerThan, OrEqualTo
cull_8 = CullPattern(List=merge_8, CullPattern=smaller_11.SmallerThan)

incurves_12 = PointInCurves(Point=facen_14.Centers, Curves=crv_12)  # -> Relationship, Index, Point
smaller_12 = SmallerThan(FirstNumber="0", SecondNumber=incurves_12.Relationship)  # -> SmallerThan, OrEqualTo
cull_9 = CullPattern(List=merge_8, CullPattern=smaller_12.SmallerThan)

# ---- group: LANDSCAPE
incurves_13 = PointInCurves(Point=facen_15.Centers, Curves=crv_13)  # -> Relationship, Index, Point
smaller_13 = SmallerThan(FirstNumber="0", SecondNumber=incurves_13.Relationship)  # -> SmallerThan, OrEqualTo
cull_10 = CullPattern(List=merge_9, CullPattern=smaller_13.SmallerThan)

incurves_14 = PointInCurves(Point=facen_15.Centers, Curves=crv_11)  # -> Relationship, Index, Point
smaller_14 = SmallerThan(FirstNumber="0", SecondNumber=incurves_14.Relationship)  # -> SmallerThan, OrEqualTo
cull_11 = CullPattern(List=merge_9, CullPattern=smaller_14.SmallerThan)

incurves_15 = PointInCurves(Point=facen_15.Centers, Curves=crv_12)  # -> Relationship, Index, Point
smaller_15 = SmallerThan(FirstNumber="0", SecondNumber=incurves_15.Relationship)  # -> SmallerThan, OrEqualTo
cull_12 = CullPattern(List=merge_9, CullPattern=smaller_15.SmallerThan)

# ---- group: LVL4
merge_10 = Merge(Data1=cull_2, Data2=cull_8, Data3=cull_5, Data4=cull_11)

# ---- group: LVL5
merge_11 = Merge(Data1=cull_3, Data2=cull_9, Data3=cull_6, Data4=cull_12)

# ---- group: LEVEL 3
merge_12 = Merge(Data1=cull, Data2=cull_7, Data3=cull_4, Data4=cull_10)

# ---- group: RISK LEVELS
entwine = Entwine(
    Branch00=mesh_16,
    Branch01=mesh_17,
    Branch02=merge_12,
    Branch03=merge_10,
    Branch04=merge_11,
    Branch05=crv_4,
    FlattenInputs=True)

# ----
move_6 = Move(Geometry=entwine, Motion=X)  # -> Geometry, Transform
bang_2 = ExplodeTree(Data=move_6.Geometry)  # -> Branch0, Branch1, Branch2, Branch3, Branch4, Branch5
merge_13 = Merge(Data1=bang_2.Branch1, Data2=bang_2.Branch2)

# ---- group: EXT_LVL1
mcol_10 = MeshColours(Mesh=bang_2.Branch0, Colours=rgb_5)

# ---- group: PROP_LVL2
mcol_11 = MeshColours(Mesh=merge_13, Colours=rgb_4)  # -> flatten(Mesh)

# ---- group: PROP_LVL2 / PROP_LVL3
mcol_12 = MeshColours(Mesh=bang_2.Branch3, Colours=rgb_3)

# ---- group: PROP_LVL2 / PROP_LVL3 / PROP_LVL4
mcol_13 = MeshColours(Mesh=bang_2.Branch4, Colours=rgb_2)

# ----
filter_7 = StreamFilter(Gate=toggle_7, Stream1=mcol_11)
filter_8 = StreamFilter(Gate=toggle_8, Stream1=mcol_12)
filter_9 = StreamFilter(Gate=toggle_9, Stream1=mcol_10)
filter_10 = StreamFilter(Gate=toggle_10, Stream1=mcol_13)

# ---- group: RH_OUT:prop_lvl_2
mesh_28 = Mesh(filter_7)

# ---- group: RH_OUT:prop_lvl_3
mesh_29 = Mesh(filter_8)

# ---- group: RH_OUT:prop_lvl_4
mesh_30 = Mesh(filter_10)

# ---- group: RH_OUT:usme_bdy
crv_23 = Curve(bang_2.Branch5)

# ----
c_script_10 = CSharpScript(mesh=filter_10)  # -> base64Draco; inputs mesh: Mesh; same code as c_script
c_script_11 = CSharpScript(mesh=filter_7)  # -> base64Draco; inputs mesh: Mesh; same code as c_script
c_script_12 = CSharpScript(mesh=filter_8)  # -> base64Draco; inputs mesh: Mesh; same code as c_script

c_script_13 = CSharpScript(mesh=filter_9)  # -> base64Draco; inputs mesh: Mesh; same code as c_script
txt_10 = Text(c_script_13)
txt_11 = Text(c_script_11)
txt_12 = Text(c_script_12)
txt_13 = Text(c_script_10)

# ---- group: RH_OUT:prop_lvl_1
mesh_31 = Mesh(filter_9)
