# Grasshopper definition Rubik Cube.gh (Grasshopper 1.0.7)
# plug-ins: Weaverbird

rh_in_amount = Slider(9, range=1..10)
rh_in_size = Slider(3, range=1..5)
rh_in_distance = Slider(8, range=1..10)
rectangle = Rectangle(Plane=PlaneXY(0, 0, 0), XSize=rh_in_size, YSize=rh_in_size, Radius=0)  # -> Rectangle, Length
series = Series(Start=expr("x+1", rh_in_size), Step=rh_in_distance, Count=rh_in_amount)
boxrec = BoxRectangle(Rectangle=rectangle.Rectangle, Height=rh_in_size)
X = UnitX(Factor=series)
series_2 = Series(Start=0, Step=rh_in_distance, Count=rh_in_amount)
move = Move(Geometry=boxrec, Motion=X)  # -> Geometry, Transform
Y = UnitY(Factor=series_2)
series_3 = Series(Start=0, Step=rh_in_distance, Count=rh_in_amount)
crossref = CrossReference(ListA=move.Geometry, ListB=Y, CrossMode=1)  # -> ListA, ListB
move_2 = Move(Geometry=crossref.ListA, Motion=crossref.ListB)  # -> Geometry, Transform
Z = UnitZ(Factor=series_3)
crossref_2 = CrossReference(ListA=move_2.Geometry, ListB=Z, CrossMode=1)  # -> ListA, ListB
move_3 = Move(Geometry=crossref_2.ListA, Motion=crossref_2.ListB)  # -> Geometry, Transform
brep = Brep(move_3.Geometry)
mesh = MeshBrep(
    Brep=brep,
    Settings={GridMaxCount=0, GridMinCount=16, JaggedSeams=False, MaxEdgeLength=0, MinEdgeLength=0.0001, MinTolerance=0, Refine=True, RefineAngle=0, RelativeTolerance=0.65, SimplePlanes=True, Tolerance=0})
wbcatmullclark = WeaverbirdsCatmullClarkSubdivision(MeshCurves=mesh, Level=2, SmoothNakedEdges=2)
mjoin = MeshJoin(Meshes=wbcatmullclark)
mcol = MeshColours(
    Mesh=mjoin,
    Colours=[RGB(127, 255, 0), RGB(0, 100, 0), RGB(34, 139, 34), RGB(124, 252, 0), RGB(154, 205, 50), RGB(173, 255, 47), RGB(50, 205, 50), RGB(152, 251, 152)])

# ---- group: RH_OUT:space
mesh_2 = Mesh(mcol)
