# Grasshopper definition rubikcube.gh (Grasshopper 1.0.7)
# plug-ins: Weaverbird

rh_in_size = Slider(5, range=1..5)
rh_in_amount = Slider(7, range=1..10)
rh_in_distance = Slider(6, range=2..10)
rectangle = Rectangle(Plane=PlaneXY(0, 0, 0), XSize=rh_in_size, YSize=rh_in_size, Radius=0)  # -> Rectangle, Length
series = Series(Start=expr("x+1", rh_in_size), Step=rh_in_distance, Count=rh_in_amount)
boxrec = BoxRectangle(Rectangle=rectangle.Rectangle, Height=rh_in_size)
X = UnitX(Factor=series)
series_2 = Series(Start=0, Step=rh_in_distance, Count=rh_in_amount)
move = Move(Geometry=boxrec, Motion=X)  # -> Geometry, Transform
Y = UnitY(Factor=series_2)
series_3 = Series(Start=0, Step=rh_in_distance, Count=rh_in_amount)
crossref = CrossReference(ListA=move.Geometry, ListB=Y, CrossMode=1)  # -> ListA, ListB
move_2 = Move(Geometry=crossref.ListA, Motion=crossref.ListB)  # -> Geometry, Transform
Z = UnitZ(Factor=series_3)
crossref_2 = CrossReference(ListA=move_2.Geometry, ListB=Z, CrossMode=1)  # -> ListA, ListB
move_3 = Move(Geometry=crossref_2.ListA, Motion=crossref_2.ListB)  # -> Geometry, Transform
brep = Brep(move_3.Geometry)
volume = Volume(Geometry=move_3.Geometry)  # -> Volume, Centroid
wbdodecahedron = WeaverbirdsPolylinesDodecahedron(Plane=volume.Centroid, Radius=expr("x-4", rh_in_amount))
bvol = BoundaryVolume(Boundaries=wbdodecahedron)
mesh = MeshBrep(
    Brep=bvol,
    Settings={GridMaxCount=0, GridMinCount=16, JaggedSeams=False, MaxEdgeLength=0, MinEdgeLength=0.0001, MinTolerance=0, Refine=True, RefineAngle=0, RelativeTolerance=0.65, SimplePlanes=True, Tolerance=0})
medges = MeshEdges(Mesh=mesh)  # -> NakedEdges, InteriorEdges, NonManifoldEdges
demesh = DeconstructMesh(Mesh=mesh)  # -> Vertices, Faces, Colours, Normals
mcol = MeshColours(Mesh=mesh, Colours=demesh.Normals)

# ---- group: RH_OUT:Curve
rh_out_curves = Curve(medges.InteriorEdges)

# ---- group: RH_OUT:space
mesh_2 = Mesh(mcol)
