# Grasshopper definition test_Y.gh (Grasshopper 1.0.7)
# plug-ins: Kangaroo2 Components

# ---- group: RH_IN:amplitude
amplitude = Slider(1, range=1..10)

# ---- group: RH_IN:height
height = Slider(2, range=1..10)

# ----
multiplication = Multiplication(A=height, B=2)
xz = XZPlane(Origin=Point(0, 0, 0))
rectangle = Rectangle(Plane=xz, XSize=multiplication, YSize=multiplication, Radius=0)  # -> Rectangle, Length
debrep = DeconstructBrep(Brep=rectangle.Rectangle)  # -> Faces, Edges, Vertices

explode = Explode(Curve=debrep.Edges, Recursive=True)  # -> Segments, Vertices
end = EndPoints(Curve=debrep.Edges)  # -> Start, End
pdecon = Deconstruct(Point=end.End)  # -> XComponent, YComponent, ZComponent
sort = SortList(Keys=pdecon.ZComponent, ValuesA=end.End)  # -> Keys, ValuesA
bang = ExplodeTree(Data=graft(sort.ValuesA))  # -> Branch0, Branch1, Branch2, Branch3

midpt = CurveMiddle(Curve=debrep.Edges)
pdecon_2 = Deconstruct(Point=midpt)  # -> XComponent, YComponent, ZComponent
sort_2 = SortList(Keys=pdecon_2.ZComponent, ValuesA=midpt)  # -> Keys, ValuesA
item = ListItem(List=sort_2.ValuesA, Index=0, Wrap=True)

area = Area(Geometry=rectangle.Rectangle)  # -> Area, Centroid

# ---- group: TOP_R_POINT
pt = Point(bang.Branch2)

# ---- group: TOP_L_POINT
pt_2 = Point(bang.Branch3)

# ---- group: BASE POINT
pt_3 = Point(item)

# ---- group: CENTER POINT
pt_4 = Point(area.Centroid)

# ----
dist = Distance(PointA=pt_4, PointB=pt_3)
vec2pt = Vector2Pt(PointA=pt_4, PointB=pt, Unitize=False)  # -> Vector, Length
multiplication_2 = Multiplication(A=dist, B=amplitude)
amp = Amplitude(Vector=vec2pt.Vector, Amplitude=multiplication_2)
move = Move(Geometry=pt, Motion=amp)  # -> Geometry, Transform
yz = YZPlane(Origin=pt_4)
pt_5 = Point(move.Geometry)
entwine = Entwine(Branch00=pt_3, Branch01=pt_4, Branch02=pt_5, FlattenInputs=True)
mirror = Mirror(Geometry=pt_5, Plane=yz)  # -> Geometry, Transform
pt_6 = Point(mirror.Geometry)
pline = PolyLine(Vertices=flatten(entwine), Closed=False)
ln = Line(StartPoint=pt_4, EndPoint=pt_6)

height_2 = Panel(dist)
result = Panel(multiplication_2)

join = JoinCurves(Curves=[ln, pline], Preserve=False)
mp = MultiPipe(
    Curves=flatten(join),
    NodeSize=Slider(0.165, range=0..1),
    EndOffset=Slider(4.917, range=0..10),
    StrutSize=Slider(0.53, range=0..2),
    Segment=0,
    KinkAngle=0.6,
    CubeFit=0,
    Caps=Slider(1, range=1..2))
meshsubd = MeshFromSubD(SubD=mp, Density=Slider(2, range=1..3))

demesh = DeconstructMesh(Mesh=meshsubd)  # -> Vertices, Faces, Colours, Normals
mcol = MeshColours(Mesh=meshsubd, Colours=demesh.Normals)

# ---- group: RH_OUT:mesh
mesh = Mesh(mcol)
